# Grasshopper definition GADCurveExtrude.gh (Grasshopper 0.9.62)
# Copyright: Nono 2014
# Copyright: Nono 2013

crv = Curve(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)
Z = UnitZ(Factor=1)

# ---- group: SRF
extrude = Extrude(outline=crv, start=Slider(1.35, range=0..10), height=Slider(2.45, range=0..10), axis=Z)

# ==== cluster Extrude
Z = UnitZ(Factor=1)
height = ClusterInput()
start = ClusterInput()
outline = ClusterInput()
axis = ClusterInput()  # Axis to move and extrude (defaults to Z)
vec = Vector([axis, Z])
item = ListItem(List=vec, Index=0, Wrap=True)
multiplication = Multiplication(A=start, B=item)
multiplication_2 = Multiplication(A=height, B=item)
move = Move(Geometry=outline, Motion=multiplication)  # -> Geometry, Transform
boundary = BoundarySurfaces(Edges=move.Geometry)
extr = Extrude(Base=boundary, Direction=multiplication_2)
solid = ClusterOutput(extr)
