# Grasshopper definition GADCurveOffset.gh (Grasshopper 0.9.76)
# Copyright: Nono 2013
# Copyright: Nono 2014

# Get short and long offsets
crv = Curve(<curve referenced from the Rhino model>)
offset = Slider(0.74, range=0..1)
cluster = Cluster(crv=crv, num=offset)  # -> short, long
shortoffset = Curve(cluster.short)
longoffset = Curve(cluster.long)

# ==== cluster Cluster
num = ClusterInput()
crv = ClusterInput()
num_2 = Number(num)
crv_2 = Curve(crv)
offset = Offset(Curve=crv_2, Distance=expr("-x", num_2), Plane=PlaneXY(0, 0, 0), Corners=1)
offset_2 = Offset(Curve=crv_2, Distance=num_2, Plane=PlaneXY(0, 0, 0), Corners=1)
len = Length(Curve=offset_2)
len_2 = Length(Curve=offset)
larger = LargerThan(FirstNumber=len, SecondNumber=len_2)  # -> LargerThan, OrEqualTo
larger_2 = LargerThan(FirstNumber=len_2, SecondNumber=len)  # -> LargerThan, OrEqualTo
dispatch = Dispatch(List=offset_2, DispatchPattern=larger.LargerThan)  # -> ListA, ListB
dispatch_2 = Dispatch(List=offset, DispatchPattern=larger_2.LargerThan)  # -> ListA, ListB
geo = Geometry([dispatch.ListB, dispatch_2.ListB])
geo_2 = Geometry([dispatch.ListA, dispatch_2.ListA])
short = ClusterOutput(geo)
long = ClusterOutput(geo_2)
