# Grasshopper definition GADCurveThicken.gh (Grasshopper 0.9.62)
# Copyright: Nono 2014

thickness = Slider(0.03, range=0..0.1)
crv = Curve(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)
thicken = Thicken(crv=crv, num=thickness)

# ==== cluster Thicken
num = ClusterInput()
crv = ClusterInput()
num_2 = Number(num)
crv_2 = Curve(crv)
offset = Offset(Curve=crv_2, Distance=num_2, Plane=PlaneXY(0, 0, 0), Corners=1)
neg = Negative(Value=num_2)
offset_2 = Offset(Curve=crv_2, Distance=neg, Plane=PlaneXY(0, 0, 0), Corners=1)
end = EndPoints(Curve=offset)  # -> Start, End
end_2 = EndPoints(Curve=offset_2)  # -> Start, End
ln = Line(StartPoint=end.Start, EndPoint=end_2.Start)
ln_2 = Line(StartPoint=end.End, EndPoint=end_2.End)
join = JoinCurves(Curves=[ln, ln_2, offset, offset_2], Preserve=False)
C = ClusterOutput(join)
