# Grasshopper definition GADCurveWiggle.gh (Grasshopper 0.9.62)
# Copyright: Nono 2014

crv = Curve(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)
wiggle = Wiggle(crv=graft(crv), divisionlength=Slider(0.837, range=0..1), thickness=Slider(0.32, range=0..1))

# ==== cluster Wiggle
divisionlength = ClusterInput()
crv = ClusterInput()
thickness = ClusterInput()
crv_2 = Curve(crv)
num = Number(divisionlength)
num_2 = Number(thickness)
# Calculate Number of Divisions
len = Length(Curve=crv_2)
division = Division(A=len, B=num)
pi = Pi(Factor=1)
num_3 = Number(division)
multiplication = Multiplication(A=num_3, B=Slider(4, range=0..10))
division_2 = Division(A=pi, B="2")
num_4 = Number(multiplication)
series = Series(Start=0, Step=division_2, Count=num_4)
sin = Sine(Value=series)
divide = DivideCurve(Curve=crv_2, Count=num_4, Kinks=False)  # -> Points, Tangents, Parameters
hframe = HorizontalFrame(Curve=crv_2, Parameter=divide.Parameters)
deplane = DeconstructPlane(Plane=hframe)  # -> Origin, XAxis, YAxis, ZAxis
multiplication_2 = Multiplication(A=deplane.YAxis, B=sin)
division_3 = Division(A=num_2, B=Slider(2, range=0..10))
multiplication_3 = Multiplication(A=multiplication_2, B=division_3)
move = Move(Geometry=divide.Points, Motion=multiplication_3)  # -> Geometry, Transform
intcrv = Interpolate(Vertices=move.Geometry, Degree=3, Periodic=False, KnotStyle=1)  # -> Curve, Length, Domain
C = ClusterOutput(intcrv.Curve)
