# Grasshopper definition GADGeometryExtrudeFromCenter.gh (Grasshopper 0.9.76)

rectangle = Rectangle(Plane=PlaneXY(0, 0, 0), XSize=Domain(-1, 1), YSize=Domain(-2, 2), Radius=0)  # -> Rectangle, Length
Z = UnitZ(Factor=1)
extcenter = ExtCenter(G=rectangle.Rectangle, D=Z, L=Slider(2.17, range=0..10))

# ==== cluster ExtCenter
D = ClusterInput()
L = ClusterInput()
G = ClusterInput()
vec = Vector(D)
multiplication = Multiplication(Vec=vec, B=L)
extr = Extrude(Base=G, Direction=multiplication)
neg = Negative(Value=multiplication)
multiplication_2 = Multiplication(A=neg, B="0.5")
move = Move(Geometry=extr, Motion=multiplication_2)  # -> Geometry, Transform
geo = Geometry(move.Geometry)
geo_2 = ClusterOutput(geo)
