# Grasshopper definition GADGeometrySortByNeighbours_v02_beta.gh (Grasshopper 0.9.76)

# Elements should be provided in layers, and should be lists with the same amount of items.
panel = Panel("Automatically find neighbours")
pipeline = GeometryPipeline(
    GroupByLayer=False,
    GroupByType=False,
    IncludeHidden=True,
    IncludeLocked=True,
    LayerFilter="Crv_A",
    NameFilter="*",
    TypeFilter=4)
pipeline_2 = GeometryPipeline(
    GroupByLayer=False,
    GroupByType=False,
    IncludeHidden=True,
    IncludeLocked=True,
    LayerFilter="Crv_B",
    NameFilter="*",
    TypeFilter=4)
pipeline_3 = GeometryPipeline(
    GroupByLayer=False,
    GroupByType=False,
    IncludeHidden=True,
    IncludeLocked=True,
    LayerFilter="Crv_C",
    NameFilter="*",
    TypeFilter=4)  # disabled
sort = Sort(sortingelement=pipeline, elementtosort=pipeline_3)
sort_2 = Sort(sortingelement=pipeline, elementtosort=pipeline_2)
# STILL IN DEVELOPMENT, IT DOES NOT WORK PROPERLY
number_slider = Slider(1, range=0..8)
crvboundary = Curve(pipeline)
crvplane = Curve(sort_2)
crvwindow = Curve(sort)
item = ListItem(List=crvboundary, Index=number_slider, Wrap=True)
item_2 = ListItem(List=crvplane, Index=number_slider, Wrap=True)
item_3 = ListItem(List=crvwindow, Index=number_slider, Wrap=True)
neighbours = Curve([item, item_2, item_3])

# ==== cluster Sort
elementtosort = ClusterInput()
sortingelement = ClusterInput()
elementtosort_2 = Geometry(elementtosort)
area = Area(SortingElement=sortingelement)  # -> Area, Centroid
bbox = BoundingBox(Content=elementtosort_2, Plane=PlaneXY(0, 0, 0))  # -> Box, Box_2
boxprop = BoxProperties(Box=bbox.Box)  # -> Center, Diagonal, Area, Volume, Degeneracy
cp = ClosestPoint(Point=boxprop.Center, Cloud=area.Centroid)  # -> ClosestPoint, CPIndex, Distance
item = ListItem(List=elementtosort_2, Index=cp.CPIndex, Wrap=True)
ptsearcher = Point(boxprop.Center)
ptsearched = Point(cp.ClosestPoint)
i = ClusterOutput(item)
index = ItemIndex(List=boxprop.Center, Item=ptsearched)
ln = Line(StartPoint=ptsearcher, EndPoint=ptsearched)
