# Grasshopper definition GADLineFromCenter.gh (Grasshopper 0.9.76)

vec = VectorXYZ(XComponent=Slider(1, range=0..1), YComponent=Slider(2, range=0..10), ZComponent=Slider(0, range=0..100))  # -> Vector, Length
pt = ConstructPoint(XCoordinate=0, YCoordinate=0, ZCoordinate=0)
linevertical = LineVertical()
linehorizontal = LineHorizontal_2()
linecenter = LineCenter(C=pt, D=vec.Vector, L=Slider(100, range=0..100))

# ==== cluster LineCenter
D = ClusterInput()
L = ClusterInput()
C = ClusterInput()
unit = UnitVector(Vector=D)
neg = Negative(Value=unit)
multiplication = Multiplication(A=neg, B="0.5")
line = LineSDL(Start=C, Direction=D, Length=L)
multiplication_2 = Multiplication(A=multiplication, B=L)
move = Move(Geometry=line, Motion=multiplication_2)  # -> Geometry, Transform
L_2 = ClusterOutput(move.Geometry)

# ==== cluster LineVertical
X = ClusterInput()
addition = Addition(A=X, B="0")
cluster = Cluster()
vec = VectorXYZ(XComponent="0", YComponent=addition, ZComponent="0")  # -> Vector, Length
move = Move(Geometry=cluster, Motion=vec.Vector)  # -> Geometry, Transform
line = ClusterOutput(move.Geometry)

# ==== cluster LineHorizontal_2
A = ClusterInput()
addition = Addition(A=A, B=Slider(0, range=0..100))
linehorizontal = LineHorizontal()
vec = VectorXYZ(XComponent="0", YComponent=addition, ZComponent="0")  # -> Vector, Length
move = Move(Geometry=linehorizontal, Motion=vec.Vector)  # -> Geometry, Transform
line = ClusterOutput(move.Geometry)

# ==== cluster Cluster
Y = UnitY(Factor=1)
pt = PointXYZ(XComponent=0, YComponent=0, ZComponent=0, System=PlaneXY(0, 0, 0))
linefromcenter = LineCenter(C=pt, D=Y, L=Slider(99999, range=0..100000))
L = ClusterOutput(linefromcenter)

# ==== cluster LineHorizontal
X = UnitX(Factor=1)
pt = PointXYZ(XComponent=0, YComponent=0, ZComponent=0, System=PlaneXY(0, 0, 0))
linefromcenter = LineCenter(C=pt, D=X, L=Slider(99999, range=0..100000))
L = ClusterOutput(linefromcenter)
