# Grasshopper definition GADListRemoveExtremes.gh (Grasshopper 0.9.62)
# Copyright: Nono 2014
# Copyright: Nono 2013

start = Slider(1, range=0..10)
end = Slider(1, range=0..10)
split = TextSplit(Text="1,2,3,4,5,6,7", Separators=",")
removeextremes = RemoveExtremes(list=split, start=start, end=end)
panel = Panel(removeextremes)

# ==== cluster RemoveExtremes
end = ClusterInput()
start = ClusterInput()
list = ClusterInput()
lng = ListLength(List=list)
subtraction = Subtraction(A=lng, B=Slider(1, range=0..10))
subtraction_2 = Subtraction(A=subtraction, B=end)
dom = ConstructDomain(DomainStart=start, DomainEnd=subtraction_2)
subset = SubList(List=list, Domain=dom, Wrap=True)  # -> List, Index
sublist = ClusterOutput(subset.List)
