# Grasshopper definition GADPatternMaker.gh (Grasshopper 0.9.76)

X = Slider(2.39, range=0..10)
Y = Slider(3.68, range=0..10)
radius = Slider(2.06, range=0..10)
offset = Slider(0.18, range=0..1)
X_2 = Slider(3.5, range=0..10)
Y_2 = Slider(3.4, range=0..10)
radius_2 = Slider(1.82, range=0..10)
offset_2 = Slider(0.16, range=0..1)
X_3 = Slider(3.5, range=0..10)
Y_3 = Slider(3.24, range=0..10)
radius_3 = Slider(2.06, range=0..10)
offset_3 = Slider(0.12, range=0..1)
panel = Panel("SETTINGS")
panel_2 = Panel("KEYS")
split = TextSplit(Text="x,y,radius,offset", Separators=",")
settings_c = Text([X, Y, radius, offset])
settings_b = Text([X_2, Y_2, radius_2, offset_2])
settings_a = Text([X_3, Y_3, radius_3, offset_3])
xy = XYPlane(Origin=Point(0, 0, 0))
keys = Text(split)
values = Text(settings_b)
keysearch = KeyValueSearch(Keys=keys, Values=values, Search="offset")
keysearch_2 = KeyValueSearch(Keys=keys, Values=values, Search="x")
keysearch_3 = KeyValueSearch(Keys=keys, Values=values, Search="y")
keysearch_4 = KeyValueSearch(Keys=keys, Values=values, Search="radius")
x = Number(keysearch_2)
y = Number(keysearch_3)
radius_4 = Number(keysearch_4)
offset_4 = Number(keysearch)

# ---- group: SETTINGS
x_2 = Number(x)
y_2 = Number(y)
radius_5 = Number(radius_4)
offset_5 = Number(offset_4)

# ----
cir = Circle(Plane=xy, Radius=radius_5)
offset_6 = Offset(Curve=cir, Distance=offset_5, Plane=PlaneXY(0, 0, 0), Corners=1)
crv = Curve(offset_6)
geo = Geometry([cir, crv])

# ---- group: Center
deplane = DeconstructPlane(Plane=xy)  # -> Origin, XAxis, YAxis, ZAxis
multiplication = Multiplication(A=deplane.XAxis, B=x_2)
multiplication_2 = Multiplication(A=deplane.YAxis, B=y_2)
neg = Negative(Value=multiplication_2)
neg_2 = Negative(Value=multiplication)
addition = Addition(A=neg_2, B=neg)

# ----
multiplication_3 = Multiplication(A=x_2, B="2")
multiplication_4 = Multiplication(A=y_2, B="2")
rectangle = Rectangle(Plane=xy, XSize=multiplication_3, YSize=multiplication_4, Radius=0)  # -> Rectangle, Length
neg_3 = Negative(Value=x_2)
neg_4 = Negative(Value=y_2)
pt = ConstructPoint(XCoordinate=neg_3, YCoordinate=0, ZCoordinate=0)
pt_2 = ConstructPoint(XCoordinate=x_2, YCoordinate=0, ZCoordinate=0)
pt_3 = ConstructPoint(XCoordinate=0, YCoordinate=neg_4, ZCoordinate=0)
pt_4 = ConstructPoint(XCoordinate=0, YCoordinate=y_2, ZCoordinate=0)
number_slider = Slider(9, range=0..10)
move = Move(Geometry=rectangle.Rectangle, Motion=addition)  # -> Geometry, Transform
orient = Orient(Geometry=geo, Source=PlaneXY(0, 0, 0), Target=[pt_4, pt, pt_3, pt_2])  # -> Geometry, Transform
pipeline = GeometryPipeline(
    GroupByLayer=False,
    GroupByType=False,
    IncludeHidden=True,
    IncludeLocked=True,
    LayerFilter="Pattern",
    NameFilter="*",
    TypeFilter=4)
series = Series(Start=number_slider, Step=y_2, Count=10)
crv_2 = Curve(flatten([orient.Geometry, geo, pipeline]))
series_2 = Series(Start=number_slider, Step=x_2, Count=10)
Z = UnitZ(Factor=1)
boundary = BoundarySurfaces(Edges=move.Geometry)
extr = Extrude(Base=crv_2, Direction=Z)
pt_5 = ConstructPoint(XCoordinate=series_2, YCoordinate=graft(series), ZCoordinate=0)
bbx = BrepBrep(BrepA=extr, BrepB=boundary)  # -> flatten(Curves), Points
group = Group(Objects=bbx.Curves)

neg_5 = Negative(Value=Slider(10, range=0..10))
geo_2 = Geometry([group, move.Geometry])
Y_4 = UnitY(Factor=neg_5)
move_2 = Move(Geometry=geo_2, Motion=Y_4)  # -> Geometry, Transform

orient_2 = Orient(Geometry=flatten(group), Source=xy, Target=flatten(pt_5))  # -> Geometry, Transform
