# Grasshopper definition GADPeopleMaker.gh (Grasshopper 0.9.76)
# Copyright: Nono 2013

crv = Curve(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)
amount = Slider(9, range=0..100)
# PEOPLE: Populate Surface With Amount, Angle
number_slider = Slider(148, range=0..360)
boundary = BoundarySurfaces(Edges=crv)
peoplemaker = PeopleMaker(angle=number_slider, surface=boundary, amount=amount, seed=Slider(37, range=0..100))

# ==== cluster PeopleMaker
surface = ClusterInput()
angle = ClusterInput()
amount = ClusterInput()
crv = Curve(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)
pt = ConstructPoint(XCoordinate=0, YCoordinate=0, ZCoordinate=0)
seed = ClusterInput()
rotate = Rotate(Geometry=crv, Angle=degrees(angle), Plane=PlaneXY(0, 0, 0))  # -> Geometry, Transform
popgeo = PopulateGeometry(Geometry=surface, Count=amount, Seed=seed)
vec2pt = Vector2Pt(PointA=pt, PointB=popgeo, Unitize=False)  # -> Vector, Length
move = Move(Geometry=rotate.Geometry, Motion=vec2pt.Vector)  # -> Geometry, Transform
people = ClusterOutput(move.Geometry)
