# Grasshopper definition GADPointOnPlane.gh (Grasshopper 0.9.76)

crv = Curve(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)
pln = Plane(crv)
xyzonplane = XYZOnPlane(pln=pln, X=Slider(0, range=0..10), Y=Slider(4, range=0..10), Z=Slider(0, range=0..10))  # -> V, pt_3
vdis = VectorDisplay(Anchor=pln, Vector=xyzonplane.V)
pt = Point(xyzonplane.pt_3)

# ==== cluster XYZOnPlane
X = ClusterInput()
Y = ClusterInput()
Z = ClusterInput()
pln = ClusterInput()
pt = ConstructPoint(XCoordinate=X, YCoordinate=Y, ZCoordinate=Z)
pln_2 = Plane(pln)
orient = Orient(Geometry=pt, Source=PlaneXY(0, 0, 0), Target=pln_2)  # -> Geometry, Transform
pt_2 = Point(orient.Geometry)
vec2pt = Vector2Pt(PointA=pln_2, PointB=pt_2, Unitize=False)  # -> Vector, Length
vdis = VectorDisplay(Anchor=pln_2, Vector=vec2pt.Vector)
V = ClusterOutput(vec2pt.Vector)
pt_3 = ClusterOutput(pt_2)
