# Grasshopper definition GADRectangleFromCenter.gh (Grasshopper 0.9.62)
# Copyright: Nono 2013

xy = XYPlane(Origin=Point(0, 0, 0))
Y = Slider(3, range=0..10)
filletradius = Slider(0.3, range=0..1)
X = Slider(4, range=0..10)
recfromcenter = RecFromCenter(pln=xy, X=X, Y=Y, R=filletradius)  # -> G, L
panel = Panel(recfromcenter.L)
rectangle = Curve(recfromcenter.G)

# ==== cluster RecFromCenter
Y = ClusterInput()
X = ClusterInput()
pln = ClusterInput()
Y_2 = Number(Y)
X_2 = Number(X)
pln_2 = Plane(pln)
R = ClusterInput()
deplane = DeconstructPlane(Plane=pln_2)  # -> Origin, XAxis, YAxis, ZAxis
rectangle = Rectangle(Plane=pln_2, XSize=X_2, YSize=Y_2, Radius=R)  # -> Rectangle, Length
neg = Negative(Value=deplane.XAxis)
neg_2 = Negative(Value=deplane.YAxis)
L = ClusterOutput(rectangle.Length)
multiplication = Multiplication(A=neg_2, B="0.5")
multiplication_2 = Multiplication(A=neg, B="0.5")
multiplication_3 = Multiplication(A=multiplication, B=Y_2)
multiplication_4 = Multiplication(A=multiplication_2, B=X_2)
addition = Addition(A=multiplication_3, B=multiplication_4)
move = Move(Geometry=rectangle.Rectangle, Motion=addition)  # -> Geometry, Transform
G = ClusterOutput(move.Geometry)
