# Grasshopper definition GADWorkflowBake.gh (Grasshopper 0.9.76)
# plug-ins: EleFront

button = Button()

join = TextJoin(Text=["Output::", "st-Slab"])
attributes = ObjectAttributes(Layer=join)
bake = BakeObjects(Attributes=attributes, Bake=button)

join_2 = TextJoin(Text=["Output::", "st-Column"])
attributes_2 = ObjectAttributes(Layer=join_2)
bake_2 = BakeObjects(Attributes=attributes_2, Bake=button)
