# Grasshopper definition GADWorkflowDictionary.gh (Grasshopper 0.9.76)

length = Slider(22, range=0..100)
height = Slider(31, range=0..100)
width = Slider(18, range=0..100)
panel = Panel("SETTINGS")
panel_2 = Panel("KEYS")
split = TextSplit(Text="width,length,height", Separators=",")
split_2 = TextSplit(Text="5,2,6", Separators=",")
split_3 = TextSplit(Text="4,22,4", Separators=",")
split_4 = TextSplit(Text="1,6,30", Separators=",")
settings_a = Text(split_2)
settings_b = Text(split_3)
settings_c = Text(split_4)
settings_d = Text([width, length, height])
keys = Text(split)
values = Text(settings_d)
keysearch = KeyValueSearch(Keys=keys, Values=values, Search="width")
keysearch_2 = KeyValueSearch(Keys=keys, Values=values, Search="length")
keysearch_3 = KeyValueSearch(Keys=keys, Values=values, Search="height")
width_2 = Number(keysearch)
length_2 = Number(keysearch_2)
height_2 = Number(keysearch_3)
rectangle = Rectangle(Plane=PlaneXY(0, 0, 0), XSize=width_2, YSize=length_2, Radius=0)  # -> Rectangle, Length
Z = UnitZ(Factor=height_2)
boundary = BoundarySurfaces(Edges=rectangle.Rectangle)
extr = Extrude(Base=boundary, Direction=Z)
box = Brep(extr)
