# Grasshopper definition GettingArchitectureDoneKit.gh (Grasshopper 0.9.62)
# Copyright: Nono 2013
# Copyright: Nono 2014

# SRF: Ondulated Panel With Curve, divisionLength, Thickness, Height
dividisionlength = Slider(0.078, range=0..1)
# PEOPLE: Populate Surface With Amount, Angle
number_slider = Slider(148, range=0..360)
crv = Curve(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)
amount = Slider(9, range=0..100)
# BUILDING: Inclined Roof With Crvs, Z, Height
number_slider_2 = Slider(37, range=0..100)
# CRV: Line With Center, Direction, Length
pt = ConstructPoint(XCoordinate=0, YCoordinate=0, ZCoordinate=0)
# SRF: Solid With Outline, Base Z, Height
crv_2 = Curve(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)
thickness = Slider(0.005, range=0..0.01)
# CRV: Thicken With Offset Thickness
crv_3 = Curve(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)
# NOGrasshopperUtil
# 
# Developed by Nono Martínez Alonso (@nonoesp)
# LIST: Remove List Extremes
panel = Panel("1,2,3,4,5,6,7")
crv_4 = Curve(<curve referenced from the Rhino model>)
crv_5 = Curve(<curve referenced from the Rhino model>)
# CRV: Closed Outline From 2 Open Crvs
number_slider_3 = Slider(3.445, range=0..10)
thickness_2 = Slider(0.02, range=0..1)
height = Slider(2.64, range=0..10)
beamthickness = Slider(0.05, range=0..1)
panel_2 = Panel("Close Crv")
# SRF: Beam With CRV, Height, Thickness
beamheight = Slider(0.03, range=0..1)
boundary = BoundarySurfaces(Edges=crv)
crv_6 = Curve(<curve referenced from the Rhino model>)
crv_7 = Curve(<curve referenced from the Rhino model>)
# Close Crv from 2 open Crvs
crv_8 = Curve(<curve referenced from the Rhino model>)
crv_9 = Curve([<curve referenced from the Rhino model> x3])
crv_10 = Curve([<curve referenced from the Rhino model> x3])
crv_11 = Curve([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])
split = TextSplit(Text=panel, Separators=",")

start = Slider(1, range=0..10)
end = Slider(1, range=0..10)
remove_extremes = RemoveExtremes(list=split, start=start, end=end)
peoplemaker = PeopleMaker(angle=number_slider, surface=boundary, amount=amount, seed=number_slider_2)
cluster = Cluster_4(basecrvs=crv_9, topcrvs=crv_10, Z=Slider(8.57, range=0..30), height=number_slider_3)
cluster_2 = Cluster(center=pt, direction=Vector(0, 0, 1), length=Slider(0.06, range=0..0.1))
cluster_3 = Cluster_6(crv=crv_4, crv_2=crv_5)
# Needs to be separated from polyline to end points with lines, because when there are more than 2 curves it messes up.
cluster_4 = Cluster_2(crv=crv_3, D=thickness)

cluster_5 = Cluster_10(crv=crv_7)
crv_12 = Curve([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])
cluster_6 = Cluster_8(crv=crv_8, crv_2=crv_6)  # -> crv_5, crv_6
# TODO: Get short and long offsets
cluster_7 = Cluster_7()  # -> short, long
cluster_8 = Cluster_7()  # -> short, long

# ---- group: SRF
cluster_9 = Cluster_11(crv=crv_11, divisionlength=dividisionlength, thickness=thickness_2, height=height)
cluster_10 = Cluster_3(outline=crv_2, start=Slider(3.15, range=0..10), height=Slider(2.55, range=0..10))

# ----
cluster_11 = Cluster_12(crv=crv_12, beamheight=beamheight, beamthickness=beamthickness)  # -> beam, beammirror
panel_3 = Panel(remove_extremes)
geo = Geometry(cluster_11.beam)
# Rectangle With Center Origin Plane, X, Y
cluster_12 = Cluster_9()
# CRV: Thicken With Offset Thickness (Thicken from center)
number_slider_4 = Slider(0.03, range=0..0.1)
crv_13 = Curve(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)
cluster_13 = Cluster_5(crv=crv_13, num=number_slider_4)

# ==== cluster RemoveExtremes
end = ClusterInput()
start = ClusterInput()
list = ClusterInput()
lng = ListLength(List=list)
subtraction = Subtraction(A=lng, B=Slider(1, range=0..10))
subtraction_2 = Subtraction(A=subtraction, B=end)
dom = ConstructDomain(DomainStart=start, DomainEnd=subtraction_2)
subset = SubList(List=list, Domain=dom, Wrap=True)  # -> List, Index
sublist = ClusterOutput(subset.List)

# ==== cluster Cluster
center = ClusterInput()
direction = ClusterInput()
length = ClusterInput()
division = Division(A=length, B="2")
neg = Negative(Value=division)
line = LineSDL(Start=graft(center), Direction=direction, Length=[division, neg])  # -> flatten(Line)
join = JoinCurves(Curves=line, Preserve=False)
C = ClusterOutput(join)

# ==== cluster Cluster_2
crv = ClusterInput()
D = ClusterInput()
crv_2 = Curve(crv)
offset = Offset(Curve=crv_2, Distance=D, Plane=PlaneXY(0, 0, 0), Corners=1)
end = EndPoints(Curve=[offset, crv_2])  # -> Start, End
pline = PolyLine(Vertices=flatten(end.End), Closed=False)
pline_2 = PolyLine(Vertices=flatten(end.Start), Closed=False)
join = JoinCurves(Curves=[pline_2, offset, pline, crv_2], Preserve=False)
C = ClusterOutput(join)

# ==== cluster Cluster_3
height = ClusterInput()
start = ClusterInput()
outline = ClusterInput()
Z = UnitZ(Factor=start)
Z_2 = UnitZ(Factor=height)
move = Move(Geometry=outline, Motion=Z)  # -> Geometry, Transform
boundary = BoundarySurfaces(Edges=move.Geometry)
extr = Extrude(Base=boundary, Direction=Z_2)
solid = ClusterOutput(extr)

# ==== cluster PeopleMaker
surface = ClusterInput()
angle = ClusterInput()
amount = ClusterInput()
crv = Curve(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)
pt = ConstructPoint(XCoordinate=0, YCoordinate=0, ZCoordinate=0)
seed = ClusterInput()
rotate = Rotate(Geometry=crv, Angle=degrees(angle), Plane=PlaneXY(0, 0, 0))  # -> Geometry, Transform
popgeo = PopulateGeometry(Geometry=surface, Count=amount, Seed=seed)
vec2pt = Vector2Pt(PointA=pt, PointB=popgeo, Unitize=False)  # -> Vector, Length
move = Move(Geometry=rotate.Geometry, Motion=vec2pt.Vector)  # -> Geometry, Transform
people = ClusterOutput(move.Geometry)

# ==== cluster Cluster_4
topcrvs = ClusterInput()
height = ClusterInput()
basecrvs = ClusterInput()
Z = ClusterInput()
crv = Curve(graft(topcrvs))
crv_2 = Curve(graft(basecrvs))
addition = Addition(A=Z, B=height)
Z_2 = UnitZ(Factor=addition)
Z_3 = UnitZ(Factor=Z)
move = Move(Geometry=crv, Motion=Z_3)  # -> Geometry, Transform
move_2 = Move(Geometry=crv_2, Motion=Z_2)  # -> Geometry, Transform
move_3 = Move(Geometry=crv_2, Motion=Z_3)  # -> Geometry, Transform
loft_opt = LoftOptions(Closed=False, Adjust=False, Rebuild=0, Refit=0, Type=Slider(3, range=0..10))
geo = Geometry(move_2.Geometry)
loft = Loft(Curves=[move_2.Geometry, move_3.Geometry, move.Geometry, geo], Options=loft_opt)
cap = CapHoles(Brep=loft)
roof = ClusterOutput(cap)

# ==== cluster Cluster_5
num = ClusterInput()
crv = ClusterInput()
num_2 = Number(num)
crv_2 = Curve(crv)
offset = Offset(Curve=crv_2, Distance=num_2, Plane=PlaneXY(0, 0, 0), Corners=1)
neg = Negative(Value=num_2)
offset_2 = Offset(Curve=crv_2, Distance=neg, Plane=PlaneXY(0, 0, 0), Corners=1)
end = EndPoints(Curve=offset)  # -> Start, End
end_2 = EndPoints(Curve=offset_2)  # -> Start, End
ln = Line(StartPoint=end.Start, EndPoint=end_2.Start)
ln_2 = Line(StartPoint=end.End, EndPoint=end_2.End)
join = JoinCurves(Curves=[ln, ln_2, offset, offset_2], Preserve=False)
C = ClusterOutput(join)

# ==== cluster Cluster_6
crv = ClusterInput()
crv_2 = ClusterInput()
crv_3 = Curve(crv)
crv_4 = Curve(crv_2)
end = EndPoints(Curve=crv_3)  # -> Start, End
end_2 = EndPoints(Curve=crv_4)  # -> Start, End
ln = Line(StartPoint=end.Start, EndPoint=end_2.Start)
ln_2 = Line(StartPoint=end.End, EndPoint=end_2.End)
join = JoinCurves(Curves=[crv_4, crv_3, ln, ln_2], Preserve=False)
outline = ClusterOutput(join)

# ==== cluster Cluster_7
num = ClusterInput()
crv = ClusterInput()
num_2 = Number(num)
crv_2 = Curve(crv)
offset = Offset(Curve=crv_2, Distance=expr("-d", num_2), Plane=PlaneXY(0, 0, 0), Corners=1)
offset_2 = Offset(Curve=crv_2, Distance=num_2, Plane=PlaneXY(0, 0, 0), Corners=1)
len = Length(Curve=offset_2)
len_2 = Length(Curve=offset)
larger = LargerThan(FirstNumber=len, SecondNumber=len_2)  # -> LargerThan, OrEqualTo
larger_2 = LargerThan(FirstNumber=len_2, SecondNumber=len)  # -> LargerThan, OrEqualTo
dispatch = Dispatch(List=offset_2, DispatchPattern=larger.LargerThan)  # -> ListA, ListB
dispatch_2 = Dispatch(List=offset, DispatchPattern=larger_2.LargerThan)  # -> ListA, ListB
geo = Geometry([dispatch.ListB, dispatch_2.ListB])
geo_2 = Geometry([dispatch.ListA, dispatch_2.ListA])
short = ClusterOutput(geo)
long = ClusterOutput(geo_2)

# ==== cluster Cluster_8
crv = ClusterInput()
crv_2 = ClusterInput()
crv_3 = Curve(crv)
crv_4 = Curve(crv_2)
end = EndPoints(Curve=crv_3)  # -> Start, End
end_2 = EndPoints(Curve=crv_4)  # -> Start, End
end_3 = EndPoints(Curve=crv_3)  # -> Start, End
end_4 = EndPoints(Curve=crv_4)  # -> Start, End
ln = Line(StartPoint=end.Start, EndPoint=end_2.Start)
ln_2 = Line(StartPoint=end.End, EndPoint=end_2.End)
ln_3 = Line(StartPoint=end_3.Start, EndPoint=end_4.End)
ln_4 = Line(StartPoint=end_3.End, EndPoint=end_4.Start)
join = JoinCurves(Curves=[crv_3, ln_2, ln, crv_4], Preserve=False)
join_2 = JoinCurves(Curves=[crv_3, crv_4, ln_3, ln_4], Preserve=False)
crv_5 = ClusterOutput(join)
crv_6 = ClusterOutput(join_2)

# ==== cluster Cluster_9
plane = ClusterInput()
X = ClusterInput()
Y = ClusterInput()
pln = Plane(plane)
number_slider = Slider(0.5, range=0..1)
deplane = DeconstructPlane(Plane=pln)  # -> Origin, XAxis, YAxis, ZAxis
multiplication = Multiplication(A=X, B=number_slider)
multiplication_2 = Multiplication(A=Y, B=number_slider)
multiplication_3 = Multiplication(A=deplane.XAxis, B=multiplication)
multiplication_4 = Multiplication(A=deplane.YAxis, B=multiplication_2)
rectangle = Rectangle(Plane=pln, XSize=X, YSize=Y, Radius=0)  # -> Rectangle, Length
addition = Addition(A=multiplication_3, B=multiplication_4)
neg = Negative(Value=addition)
move = Move(Geometry=rectangle.Rectangle, Motion=neg)  # -> Geometry, Transform
crv = ClusterOutput(move.Geometry)

# ==== cluster Cluster_10
crv = ClusterInput()
crv_2 = Curve(crv)
end = EndPoints(Curve=crv_2)  # -> Start, End
ln = Line(StartPoint=end.Start, EndPoint=end.End)
join = JoinCurves(Curves=flatten([crv_2, ln]), Preserve=False)
C = ClusterOutput(join)

# ==== cluster Cluster_11
crv = ClusterInput()
divisionlength = ClusterInput()
thickness = ClusterInput()
height = ClusterInput()
crv_2 = Curve(crv)
num = Number(divisionlength)
num_2 = Number(thickness)
num_3 = Number(height)
# Calculate Number of Divisions
len = Length(Curve=crv)
division = Division(A=len, B=num)
pi = Pi(Factor=1)
num_4 = Number(division)
multiplication = Multiplication(A=num_4, B=Slider(4, range=0..10))
division_2 = Division(A=pi, B="2")
num_5 = Number(multiplication)
series = Series(Start=0, Step=division_2, Count=num_5)
sin = Sine(Value=series)
divide = DivideCurve(Curve=crv_2, Count=num_5, Kinks=False)  # -> Points, Tangents, Parameters
hframe = HorizontalFrame(Curve=crv_2, Parameter=divide.Parameters)
deplane = DeconstructPlane(Plane=hframe)  # -> Origin, XAxis, YAxis, ZAxis
multiplication_2 = Multiplication(A=deplane.YAxis, B=sin)
division_3 = Division(A=num_2, B=Slider(2, range=0..10))
multiplication_3 = Multiplication(A=multiplication_2, B=division_3)
move = Move(Geometry=divide.Points, Motion=multiplication_3)  # -> Geometry, Transform
intcrv = Interpolate(Vertices=move.Geometry, Degree=3, Periodic=False, KnotStyle=1)  # -> Curve, Length, Domain
Z = UnitZ(Factor=num_3)
extr = Extrude(Base=intcrv.Curve, Direction=Z)
panel = ClusterOutput(extr)

# ==== cluster Cluster_12
crv = ClusterInput()
beamheight = ClusterInput()
beamthickness = ClusterInput()

crv_2 = Curve(flatten(crv))
beamheight_2 = Number(beamheight)
beamthickness_2 = Number(beamthickness)
cluster = Cluster_7(crv=crv_2, num=beamthickness_2)  # -> short, flatten(long)
Z = UnitZ(Factor=beamheight_2)
move = Move(Geometry=crv_2, Motion=Z)  # -> flatten(Geometry), Transform
crv_3 = Curve(graft(cluster.long))
move_2 = Move(Geometry=crv_3, Motion=Z)  # -> flatten(Geometry), Transform
crv_4 = Curve(graft(move.Geometry))
crv_5 = Curve(graft(crv_2))
crv_6 = Curve(graft(move_2.Geometry))
loft_opt = LoftOptions(Closed=False, Adjust=False, Rebuild=0, Refit=0, Type="3")
loft = Loft(Curves=[crv_4, crv_5, crv_3, crv_6], Options=loft_opt)
mirror = Mirror(Geometry=loft, Plane=crv_2)  # -> Geometry, Transform

beammirror = ClusterOutput(mirror.Geometry)
beam = ClusterOutput(loft)
