# Grasshopper definition 150615_List_Pepe.gh (Grasshopper 0.9.76)

pt = Point(simplify(graft([<point referenced from the Rhino model> x4])))
pt_2 = Point(simplify(graft([<point referenced from the Rhino model> x4])))
pt_3 = Point(simplify(graft([<point referenced from the Rhino model> x4])))
panel = Panel(pt_3)
pt_4 = Point(simplify(graft([<point referenced from the Rhino model> x4])))
flatten = FlattenTree(Tree=pt_3, Path="{0}")
pt_5 = Point([<point referenced from the Rhino model> x4])
pt_6 = Point([<point referenced from the Rhino model> x4])
panel_3 = Panel(pt)
panel_4 = Panel(pt_2)
panel_5 = Panel(pt_4)
panel_6 = Panel(flatten)
item = ListItem(List=pt_5, Index=Slider(0, range=0..10), Wrap=True)
item_2 = ListItem(List=pt_5, Index=Slider(2, range=0..10), Wrap=True)
pline = PolyLine(Vertices=pt_3, Closed=False)
item_3 = ListItem(List=pt_6, Index=Slider(1, range=0..10), Wrap=True)
item_4 = ListItem(List=pt_6, Index=Slider(3, range=0..10), Wrap=True)
pt_7 = Point([pt_3, pt, pt_2, pt_4])
pline_2 = PolyLine(Vertices=pt_7, Closed=False)
pline_3 = PolyLine(Vertices=[item, item_3, item_2, item_4], Closed=False)
panel_7 = Panel(pt_7)
pt_8 = Point(pt_7)
flip = FlipMatrix(Data=pt_8)
pline_4 = PolyLine(Vertices=pt_8, Closed=False)
pline_5 = PolyLine(Vertices=flip, Closed=False)
panel_8 = Panel(flip)
panel_9 = Panel(pt_8)
