# Grasshopper definition 150615_List_Pepe2.gh (Grasshopper 0.9.76)

series = Series(Start=0, Step=1, Count=10)
pt = ConstructPoint(XCoordinate=0, YCoordinate=0, ZCoordinate=0)
X = UnitX(Factor=series)
series_2 = Series(Start=0, Step=1, Count=Slider(7, range=0..10))
move = Move(Geometry=pt, Motion=X)  # -> simplify(graft(Geometry)), Transform
panel = Panel(move.Geometry)
Y = UnitY(Factor=series_2)
move_2 = Move(Geometry=move.Geometry, Motion=Y)  # -> Geometry, Transform
panel_2 = Panel(Y)
Z = UnitZ(Factor=series_2)
move_3 = Move(Geometry=graft(move_2.Geometry), Motion=Z)  # -> simplify(Geometry), Transform
path_mapper = PathMapper(move_3.Geometry, source="{A;B}", target="{A}")
flip = FlipMatrix(Data=path_mapper)
pline = PolyLine(Vertices=flip, Closed=False)
