# Grasshopper definition GADArchitectureRoofInclined.gh (Grasshopper 0.9.62)
# Copyright: Nono 2014

# BUILDING: Inclined Roof With Crvs, Z, Height
number_slider = Slider(3.47, range=0..30)
crv = Curve(<curve referenced from the Rhino model>)
crv_2 = Curve(<curve referenced from the Rhino model>)
cluster = Cluster(basecrvs=crv, topcrvs=crv_2, Z=number_slider, height=Slider(1.245, range=0..10))

# ==== cluster Cluster
topcrvs = ClusterInput()
height = ClusterInput()
basecrvs = ClusterInput()
Z = ClusterInput()
crv = Curve(graft(topcrvs))
crv_2 = Curve(graft(basecrvs))
addition = Addition(A=Z, B=height)
Z_2 = UnitZ(Factor=addition)
Z_3 = UnitZ(Factor=Z)
move = Move(Geometry=crv, Motion=Z_3)  # -> Geometry, Transform
move_2 = Move(Geometry=crv_2, Motion=Z_2)  # -> Geometry, Transform
move_3 = Move(Geometry=crv_2, Motion=Z_3)  # -> Geometry, Transform
loft_opt = LoftOptions(Closed=False, Adjust=False, Rebuild=0, Refit=0, Type=Slider(3, range=0..10))
geo = Geometry(move_2.Geometry)
loft = Loft(Curves=[move_2.Geometry, move_3.Geometry, move.Geometry, geo], Options=loft_opt)
cap = CapHoles(Brep=loft)
roof = ClusterOutput(cap)
