# Grasshopper definition Util_metalDoor.gh (Grasshopper 0.9.62)
# Copyright: Nono 2014
# Copyright: Nono 2013

crv = Curve([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])
crv_2 = Curve([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])
crv_3 = Curve([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])
path_mapper = PathMapper(crv_3, source="{A}", target="{0;A}")
path_mapper_2 = PathMapper(crv, source="{A}", target="{1;A}")
path_mapper_3 = PathMapper(crv_2, source="{A}", target="{2;A}")
crv_4 = Curve([path_mapper, path_mapper_2, path_mapper_3])
num = Number(simplify(graft([Slider(2.5, range=0..10), Slider(0.4, range=0..1), Slider(5, range=0..10)])))
panel = Panel("Door Depth")
panel_2 = Panel("Base Curve")
panel_3 = Panel("Door Thickness")
panel_4 = Panel("Subdivisions")
panel_5 = Panel("Offset")
panel_6 = Panel("Height")
panel_7 = Panel(crv_4)
cluster = Cluster_3(
    crv=crv_4,
    thickness=Slider(0.033, range=0..0.1),
    depth=Slider(0.2, range=0..0.3),
    divisions=Slider(3, range=0..10),
    offset=Slider(0.038, range=0..1),
    height=num)
panel_8 = Panel(num)

# ==== cluster Cluster_3
thickness = ClusterInput()
divisions = ClusterInput()
height = ClusterInput()
depth = ClusterInput()
offset = ClusterInput()
crv = ClusterInput()
divisions_2 = Number(graft(height))
crv_2 = Curve(crv)
thickness_2 = Number(thickness)
depth_2 = Number(depth)
divisions_3 = Number(divisions)
divisions_4 = Number(offset)
cluster = Cluster(P=crv_2)
end = EndPoints(Curve=crv_2)  # -> Start, End
Z = UnitZ(Factor=divisions_2)
Z_2 = UnitZ(Factor=1)
multiplication = Multiplication(A=cluster, B=divisions_4)
line = LineSDL(Start=end.Start, Direction=Z_2, Length=divisions_2)
panel = Panel("Line Offset")
move = Move(Geometry=crv_2, Motion=multiplication)  # -> Geometry, Transform
move_2 = Move(Geometry=crv_2, Motion=multiplication)  # -> Geometry, Transform
pt = Point(graft(end.Start))
divide = DivideCurve(Curve=line, Count=divisions_3, Kinks=False)  # -> Points, Tangents, Parameters
vec2pt = Vector2Pt(PointA=pt, PointB=divide.Points, Unitize=False)  # -> Vector, Length
move_3 = Move(Geometry=graft(move.Geometry), Motion=vec2pt.Vector)  # -> Geometry, Transform
extr = Extrude(Base=move_2.Geometry, Direction=Z)
edges = BrepEdges(Brep=extr)  # -> Naked, Interior, NonManifold
multiplication_2 = Multiplication(A=thickness_2, B=Slider(0.5, range=0..1))
Z_3 = UnitZ(Factor=multiplication_2)
crv_3 = Curve(edges.Naked)
start = Slider(1, range=0..10)
end_2 = Slider(1, range=0..10)
neg = Negative(Value=Z_3)
join = JoinCurves(Curves=crv_3, Preserve=False)  # -> simplify(Curves)
move_4 = Move(Geometry=move_3.Geometry, Motion=neg)  # -> Geometry, Transform
cluster_2 = Cluster_2(crv=join, num=thickness_2)  # -> short, long
remove_extremes = RemoveExtremes(list=move_4.Geometry, start=start, end=end_2)
crv_4 = Curve(simplify(cluster_2.short))
ccx = CurveCurve(CurveA=crv_4, CurveB=remove_extremes)  # -> Points, ParamsA, ParamsB
multiplication_3 = Multiplication(A=cluster, B=depth_2)  # -> graft(Result)
Z_4 = UnitZ(Factor=thickness_2)
pline = PolyLine(Vertices=ccx.Points, Closed=False)  # -> simplify(Polyline)
path_mapper = PathMapper(multiplication_3, source="{A;B;C}", target="{A;C}")
boundary = BoundarySurfaces(Edges=[join, crv_4])
extr_2 = Extrude(Base=pline, Direction=Z_4)
path_mapper_2 = PathMapper(extr_2, source="{A;B;C}", target="{A;B}")
geo = Geometry([boundary, path_mapper_2])
extr_3 = Extrude(Base=geo, Direction=path_mapper)
doorstructure = ClusterOutput(extr_3)

# ==== cluster Cluster
P = ClusterInput()
deplane = DeconstructPlane(Plane=P)  # -> Origin, XAxis, YAxis, ZAxis
Z = UnitZ(Factor=1)
xprod = CrossProduct(VectorA=Z, VectorB=deplane.ZAxis, Unitize=Toggle(True))  # -> Vector, Length
vectorleft = ClusterOutput(xprod.Vector)

# ==== cluster Cluster_2
num = ClusterInput()
crv = ClusterInput()
num_2 = Number(num)
crv_2 = Curve(crv)
offset = Offset(Curve=crv_2, Distance=expr("-d", num_2), Plane=PlaneXY(0, 0, 0), Corners=1)
offset_2 = Offset(Curve=crv_2, Distance=num_2, Plane=PlaneXY(0, 0, 0), Corners=1)
len = Length(Curve=offset_2)
len_2 = Length(Curve=offset)
larger = LargerThan(FirstNumber=len, SecondNumber=len_2)  # -> LargerThan, OrEqualTo
larger_2 = LargerThan(FirstNumber=len_2, SecondNumber=len)  # -> LargerThan, OrEqualTo
dispatch = Dispatch(List=offset_2, DispatchPattern=larger.LargerThan)  # -> ListA, ListB
dispatch_2 = Dispatch(List=offset, DispatchPattern=larger_2.LargerThan)  # -> ListA, ListB
geo = Geometry([dispatch.ListB, dispatch_2.ListB])
geo_2 = Geometry([dispatch.ListA, dispatch_2.ListA])
short = ClusterOutput(geo)
long = ClusterOutput(geo_2)

# ==== cluster RemoveExtremes
end = ClusterInput()
start = ClusterInput()
list = ClusterInput()
lng = ListLength(List=list)
subtraction = Subtraction(A=lng, B=Slider(1, range=0..10))
subtraction_2 = Subtraction(A=subtraction, B=end)
dom = ConstructDomain(DomainStart=start, DomainEnd=subtraction_2)
subset = SubList(List=list, Domain=dom, Wrap=True)  # -> List, Index
sublist = ClusterOutput(subset.List)
