# Grasshopper definition Util_showVectorAxes.gh (Grasshopper 0.9.62)
# Copyright: Nono 2014

crv = Curve([<curve referenced from the Rhino model> x6])
end = EndPoints(Curve=crv)  # -> Start, End
crv_cp = CurveClosestPoint(Point=end.Start, Curve=crv)  # -> Point, Parameter, Distance
frame = CurveFrame(Curve=crv, Parameter=crv_cp.Parameter)
deplane = DeconstructPlane(Plane=frame)  # -> Origin, XAxis, YAxis, ZAxis
number_slider = Slider(0.37, range=0..1)
pt = Point(deplane.Origin)
cluster = Cluster(S=pt, D=deplane.XAxis, L=number_slider)
cluster_2 = Cluster(S=pt, D=deplane.YAxis, L=number_slider)
cluster_3 = Cluster(S=pt, D=deplane.ZAxis, L=number_slider)
Z = UnitZ(Factor=1)
xprod = CrossProduct(VectorA=Z, VectorB=deplane.ZAxis, Unitize=Toggle(True))  # -> Vector, Length
preview = CustomPreview(Geometry=cluster_2, Shader=ColourSwatch(SwatchColor=RGB(255, 0, 0)))
preview_2 = CustomPreview(Geometry=cluster_3, Shader=ColourSwatch(SwatchColor=RGB(0, 255, 0)))
cluster_4 = Cluster(S=pt, D=xprod.Vector, L=number_slider)
preview_3 = CustomPreview(Geometry=cluster_4, Shader=ColourSwatch(SwatchColor=RGB(17, 0, 255)))

# ==== cluster Cluster
S = ClusterInput()
D = ClusterInput()
L = ClusterInput()
line = LineSDL(Start=S, Direction=D, Length=L)
end = EndPoints(Curve=line)  # -> Start, End
sph = Sphere(Base=end.End, Radius=Slider(0.01, range=0..0.1))
geo = Geometry([sph, line])
geo_2 = ClusterOutput(geo)
