# Grasshopper definition Building-RailingWithSurface.gh (Grasshopper 0.9.62)
# Copyright: Nono 2014

srf = Surface(<surface referenced from the Rhino model>)
panel = Panel("Railing Builder")
edges = BrepEdges(Brep=srf)  # -> Naked, Interior, NonManifold
crv = Curve(edges.Naked)
join = JoinCurves(Curves=crv, Preserve=False)
offset = Offset(Curve=join, Distance=expr("-d", Slider(0.2, range=0..1)), Plane=PlaneXY(0, 0, 0), Corners=1)
boundary = BoundarySurfaces(Edges=flatten([offset, edges.Naked]))
Z = UnitZ(Factor=Slider(1, range=0..1))
extr = Extrude(Base=boundary, Direction=Z)
