# Grasshopper definition GADArchitectureTree.gh (Grasshopper 0.9.62)
# Copyright: Nono 2014

panel = Panel("Tree")
boxheight = Slider(0.55, range=0..1)
treeheight = Slider(2.4, range=0..10)
cluster = Cluster_3(X=Slider(0.78, range=0..1), Y=Slider(0.86, range=0..1), num_2=boxheight, num=treeheight)  # -> E_4, E_2, E_3, E
container = Geometry(cluster.E_4)
soil = Geometry(cluster.E_2)
trunk = Geometry(cluster.E_3)
leaves = Geometry(cluster.E)

# ==== cluster Cluster_3
num = ClusterInput()
num_2 = ClusterInput()
X = ClusterInput()
Y = ClusterInput()
num_3 = Number(num)
num_4 = Number(num_2)
xy = XYPlane(Origin=Point(0, 0, 0))
cluster = Cluster(plane=xy, X=X, Y=Y)
panel = Panel("Soil")
panel_2 = Panel("Box")
panel_3 = Panel("Trunk")
panel_4 = Panel("Base Bottom")
cluster_2 = Cluster_2(crv=cluster, num=Slider(0.026, range=0..0.1))  # -> short, long
boundary = BoundarySurfaces(Edges=cluster)
Z = UnitZ(Factor=num_3)
crv = Curve(cluster_2.short)
area = Area(Geometry=crv)  # -> Area, Centroid
boundary_2 = BoundarySurfaces(Edges=crv)
move = Move(Geometry=area.Centroid, Motion=Z)  # -> Geometry, Transform
circle = CircleCNR(Center=area.Centroid, Normal=Vector(0, 0, 1), Radius=Slider(0.03, range=0..1))
subtraction = Subtraction(A=num_4, B=Slider(0.04, range=0..0.1))
boundary_3 = BoundarySurfaces(Edges=flatten([cluster, crv]))
Z_2 = UnitZ(Factor=num_4)
Z_3 = UnitZ(Factor=subtraction)
boundary_4 = BoundarySurfaces(Edges=circle)
Z_4 = UnitZ(Factor=num_3)
sph = Sphere(Base=move.Geometry, Radius=Slider(0.67, range=0..1))
popgeo = PopulateGeometry(Geometry=sph, Count=Slider(30, range=0..100), Seed=1)
shift = ShiftList(List=popgeo, Shift=1, Wrap=True)
ln = Line(StartPoint=popgeo, EndPoint=shift)
circle_2 = CircleCNR(Center=popgeo, Normal=ln, Radius=Slider(0.015, range=0..0.1))
boundary_5 = BoundarySurfaces(Edges=circle_2)
extrcrv = ExtrudeAlong(Base=boundary_5, Curve=ln)
extr = Extrude(Base=boundary_2, Direction=Z_3)
extr_2 = Extrude(Base=boundary_4, Direction=Z_4)
extr_3 = Extrude(Base=boundary_3, Direction=Z_2)
E = ClusterOutput(extrcrv)
E_2 = ClusterOutput(extr)
E_3 = ClusterOutput(extr_2)
E_4 = ClusterOutput(extr_3)

# ==== cluster Cluster
plane = ClusterInput()
X = ClusterInput()
Y = ClusterInput()
pln = Plane(plane)
number_slider = Slider(0.5, range=0..1)
deplane = DeconstructPlane(Plane=pln)  # -> Origin, XAxis, YAxis, ZAxis
multiplication = Multiplication(A=X, B=number_slider)
multiplication_2 = Multiplication(A=Y, B=number_slider)
multiplication_3 = Multiplication(A=deplane.XAxis, B=multiplication)
multiplication_4 = Multiplication(A=deplane.YAxis, B=multiplication_2)
rectangle = Rectangle(Plane=pln, XSize=X, YSize=Y, Radius=0)  # -> Rectangle, Length
addition = Addition(A=multiplication_3, B=multiplication_4)
neg = Negative(Value=addition)
move = Move(Geometry=rectangle.Rectangle, Motion=neg)  # -> Geometry, Transform
crv = ClusterOutput(move.Geometry)

# ==== cluster Cluster_2
num = ClusterInput()
crv = ClusterInput()
num_2 = Number(num)
crv_2 = Curve(crv)
offset = Offset(Curve=crv_2, Distance=expr("-d", num_2), Plane=PlaneXY(0, 0, 0), Corners=1)
offset_2 = Offset(Curve=crv_2, Distance=num_2, Plane=PlaneXY(0, 0, 0), Corners=1)
len = Length(Curve=offset_2)
len_2 = Length(Curve=offset)
larger = LargerThan(FirstNumber=len, SecondNumber=len_2)  # -> LargerThan, OrEqualTo
larger_2 = LargerThan(FirstNumber=len_2, SecondNumber=len)  # -> LargerThan, OrEqualTo
dispatch = Dispatch(List=offset_2, DispatchPattern=larger.LargerThan)  # -> ListA, ListB
dispatch_2 = Dispatch(List=offset, DispatchPattern=larger_2.LargerThan)  # -> ListA, ListB
geo = Geometry([dispatch.ListB, dispatch_2.ListB])
geo_2 = Geometry([dispatch.ListA, dispatch_2.ListA])
short = ClusterOutput(geo)
long = ClusterOutput(geo_2)
