# Grasshopper definition GADCurveIntersectList.gh (Grasshopper 0.9.76)

crv = Curve(simplify(Tree({0}: [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], {1}: [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], {2}: [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], {3}: [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], {4}: [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], {5}: [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], {6}: [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], {7}: [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], {8}: [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], {9}: [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], {10}: [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], {11}: [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])))
index = ItemIndex(List=flatten(crv), Item=flatten(crv))  # -> graft(Index)
replace = ReplaceItems(List=flatten(crv), Indices=index, Wrap=False)  # -> simplify(List)
ccx = CurveCurve(CurveA=crv, CurveB=replace)  # -> Points, ParamsA, ParamsB
panel = Panel(replace)
