# Grasshopper definition GADGeometrySort.gh (Grasshopper 0.9.76)

bylength = ByLength()  # -> shorter_crv_2, longer_crv_2

# ==== cluster ByLength
crv = ClusterInput()
crv_2 = Curve(crv)
join = JoinCurves(Curves=crv_2, Preserve=False)
len = Length(Curve=join)
sort = SortList(Keys=len, ValuesA=join)  # -> Keys, ValuesA
rev = ReverseList(List=sort.ValuesA)
item = ListItem(List=sort.ValuesA, Index=0, Wrap=True)
item_2 = ListItem(List=rev, Index=0, Wrap=True)
shorter_crv = Curve(item)
longer_crv = Curve(item_2)
shorter_crv_2 = ClusterOutput(shorter_crv)
longer_crv_2 = ClusterOutput(longer_crv)
