# Grasshopper definition GADWiggleLine.gh (Grasshopper 0.9.62)
# Copyright: Nono 2014

number_slider = Slider(0.09, range=0..0.1)
number_slider_2 = Slider(0.1, range=0..0.1)
crv = Curve(<curve referenced from the Rhino model>)
crv_2 = Curve(<curve referenced from the Rhino model>)
series = Series(Start=Slider(0, range=0..100), Step=Slider(2, range=0..10), Count=Slider(30, range=0..100))
crv_3 = Curve(graft([<curve referenced from the Rhino model> x2]))
crv_4 = Curve(graft([<curve referenced from the Rhino model> x2]))
X = UnitX(Factor=series)
move = Move(Geometry=crv_2, Motion=X)  # -> Geometry, Transform
Z = UnitZ(Factor=[Slider(3, range=0..10), Slider(2, range=0..10)])  # -> graft(UnitVector)
crv_5 = Curve(crv)
num = Number(Slider(0.08, range=0..0.1))
num_2 = Number(Slider(0.02, range=0..0.1))
crv_6 = Curve([crv_4, crv_3])
curvepoint = PointOnCurve(move.Geometry, parameter=0.5)
panel = Panel(Z)
extr = Extrude(Base=crv_6, Direction=Z)
# Calculate Number of Divisions
len = Length(Curve=crv_5)
multiplication = Multiplication(A=series, B=Slider(5, range=0..100))
rotate = Rotate(Geometry=move.Geometry, Angle=degrees(multiplication), Plane=curvepoint)  # -> Geometry, Transform
cluster = Cluster_2(crv=graft(rotate.Geometry), divisionlength=Slider(0.17, range=0..1), thickness=Slider(0.1, range=0..1))
division = Division(A=len, B=num)
panel_2 = Panel(crv_6)
cluster_2 = Cluster(crv=crv_6, divisionlength=Slider(0.078, range=0..1), thickness=Slider(0.02, range=0..1), height=Z)
pi = Pi(Factor=1)
num_3 = Number(division)
multiplication_2 = Multiplication(A=num_3, B=Slider(4, range=0..10))
division_2 = Division(A=pi, B="2")
num_4 = Number(multiplication_2)
series_2 = Series(Start=0, Step=division_2, Count=num_4)
sin = Sine(Value=series_2)
divide = DivideCurve(Curve=crv_5, Count=num_4, Kinks=False)  # -> Points, Tangents, Parameters
hframe = HorizontalFrame(Curve=crv_5, Parameter=divide.Parameters)
deplane = DeconstructPlane(Plane=hframe)  # -> Origin, XAxis, YAxis, ZAxis
multiplication_3 = Multiplication(A=deplane.YAxis, B=sin)
division_3 = Division(A=num_2, B=Slider(2, range=0..10))
multiplication_4 = Multiplication(A=multiplication_3, B=division_3)
move_2 = Move(Geometry=divide.Points, Motion=multiplication_4)  # -> Geometry, Transform
intcrv = Interpolate(Vertices=move_2.Geometry, Degree=3, Periodic=False, KnotStyle=1)  # -> Curve, Length, Domain
path_mapper = PathMapper(intcrv.Curve, source="{A;B;C}", target="{A;C}")

# ==== cluster Cluster
crv = ClusterInput()
divisionlength = ClusterInput()
thickness = ClusterInput()
height = ClusterInput()
crv_2 = Curve(crv)
num = Number(divisionlength)
num_2 = Number(thickness)
num_3 = Number(height)
# Calculate Number of Divisions
len = Length(Curve=crv)
division = Division(A=len, B=num)
pi = Pi(Factor=1)
num_4 = Number(division)
multiplication = Multiplication(A=num_4, B=Slider(4, range=0..10))
division_2 = Division(A=pi, B="2")
num_5 = Number(multiplication)
series = Series(Start=0, Step=division_2, Count=num_5)
sin = Sine(Value=series)
divide = DivideCurve(Curve=crv_2, Count=num_5, Kinks=False)  # -> Points, Tangents, Parameters
hframe = HorizontalFrame(Curve=crv_2, Parameter=divide.Parameters)
deplane = DeconstructPlane(Plane=hframe)  # -> Origin, XAxis, YAxis, ZAxis
multiplication_2 = Multiplication(A=deplane.YAxis, B=sin)
division_3 = Division(A=num_2, B=Slider(2, range=0..10))
multiplication_3 = Multiplication(A=multiplication_2, B=division_3)
move = Move(Geometry=divide.Points, Motion=multiplication_3)  # -> Geometry, Transform
intcrv = Interpolate(Vertices=move.Geometry, Degree=3, Periodic=False, KnotStyle=1)  # -> Curve, Length, Domain
path_mapper = PathMapper(intcrv.Curve, source="{A;B;C}", target="{A;C}")
Z = UnitZ(Factor=num_3)
extr = Extrude(Base=path_mapper, Direction=Z)
panel = ClusterOutput(extr)

# ==== cluster Cluster_2
divisionlength = ClusterInput()
crv = ClusterInput()
thickness = ClusterInput()
crv_2 = Curve(crv)
num = Number(divisionlength)
num_2 = Number(thickness)
# Calculate Number of Divisions
len = Length(Curve=crv_2)
division = Division(A=len, B=num)
pi = Pi(Factor=1)
num_3 = Number(division)
multiplication = Multiplication(A=num_3, B=Slider(4, range=0..10))
division_2 = Division(A=pi, B="2")
num_4 = Number(multiplication)
series = Series(Start=0, Step=division_2, Count=num_4)
sin = Sine(Value=series)
divide = DivideCurve(Curve=crv_2, Count=num_4, Kinks=False)  # -> Points, Tangents, Parameters
hframe = HorizontalFrame(Curve=crv_2, Parameter=divide.Parameters)
deplane = DeconstructPlane(Plane=hframe)  # -> Origin, XAxis, YAxis, ZAxis
multiplication_2 = Multiplication(A=deplane.YAxis, B=sin)
division_3 = Division(A=num_2, B=Slider(2, range=0..10))
multiplication_3 = Multiplication(A=multiplication_2, B=division_3)
move = Move(Geometry=divide.Points, Motion=multiplication_3)  # -> Geometry, Transform
intcrv = Interpolate(Vertices=move.Geometry, Degree=3, Periodic=False, KnotStyle=1)  # -> Curve, Length, Domain
C = ClusterOutput(intcrv.Curve)
