# Grasshopper definition GetInputGUID.gh (Grasshopper 0.9.76)
# plug-ins: Python Interpreter

x = Slider(3, range=0..5)
guid = PythonScript(x=x)  # -> out, guid
# ---------- guid: Python ----------
# Source
# http://www.grasshopper3d.com/forum/topics/python-guid-sliders-conversion
# by jordje

for input in ghenv.Component.Params.Input:
    for source in input.Sources:
        print input.Name
        if input.Name == "x":
            guid = str(source.InstanceGuid)
# ---------- end guid ----------
panel = Panel(guid.guid)
