# Grasshopper definition GhDataTreesToAndFrom.gh (Grasshopper 0.9.14)
# plug-ins: Python Interpreter

# ---- group: Build GH DatTree
slider = Slider(3, range=0..10)
series = Series(Start=10, Step=1, Count=slider)
series_2 = Series(Start=20, Step=1, Count=slider)
series_3 = Series(Start=0, Step=1, Count=slider)
entwine = Entwine(Branch00=series_3, Branch01=series, Branch02=series_2)  # -> simplify(Result)

# ----
python = PythonScript(DataTree=entwine)  # -> out, a; inputs DataTree: tree of Int32
# ---------- python: Python ----------
import clr
clr.AddReference("Grasshopper")
import Grasshopper as gh


def ghDataTreeToPythonList(dataTree):
    
    """ Converts a GH datatree to a nested Python list """
    
    # Create an empty Python list
    pyList = []
    
    # Add the branches of the Gh datatree to this list
    for i in range(DataTree.BranchCount):
        branch = list(DataTree.Branch(i))
        pyList.append(branch)
        
    return pyList

def pythonListTGhDataTree(pythonList):
    
    """ Converts a  nested Python list to a GH datatree """
    
    # Create GH datatree
    dataTree = gh.DataTree[int]()
    
    # Add pythonlist sub lists to dataTree
    for i,l in enumerate(pythonList):
        for v in l:
            dataTree.Add(v,gh.Kernel.Data.GH_Path(i))
            
    return dataTree


# Convert the GH DataTree to nested list and check its content
pyList = ghDataTreeToPythonList(DataTree)
print type(pyList)
print len(pyList)
print pyList[0]
print pyList

# Do something with pyList 
pyList = [[j + 2 for j in sublist] for sublist in pyList]
print pyList

# Convert pyList to Gh Datatree and return it to GH
a = pythonListTGhDataTree(pyList)
# ---------- end python ----------
panel = Panel(python.a)
