# Grasshopper definition Helper_DirectionAngle.gh (Grasshopper 0.9.76)

walkwaytiltpercent = Slider(7.5, range=0..20)
panel = Panel("AngleVectorWithTilt")
panel_2 = Panel("AngleDirectionWithTan")
neg = Negative(Value=walkwaytiltpercent)
division = Division(A=walkwaytiltpercent, B="100")
vec = VectorXYZ(XComponent="100", YComponent="0", ZComponent=neg)  # -> Vector, Length
atan = ArcTangent(Value=division)
X = UnitX(Factor=1)
deg = Degrees(Radians=atan)
angle = Angle(VectorA=vec.Vector, VectorB=X)  # -> Angle, Reflex
deg_2 = Degrees(Radians=angle.Angle)
panel_3 = Panel(atan)
panel_4 = Panel(angle.Angle)
panel_5 = Panel(deg)
panel_6 = Panel(deg_2)
