# Grasshopper definition Helper_Panelizer_Version_3.0.gh (Grasshopper 0.9.76)
# Copyright: Foster + Partners
# plug-ins: Weaverbird

# ---- group: Panelizer v3.0
crv = Curve(flatten([<curve referenced from the Rhino model> x5]))
number_slider = Slider(14, range=0..100)
toggle = BooleanToggle(True)
sortcurves = SortCurves(crv=crv)  # -> crv_13, crv_14, crv_15, crv_16
bridge2crv = Bridge2Crv(C_2=sortcurves.crv_13, C=sortcurves.crv_14, N=number_slider, close=toggle)  # -> Q, triangletop, trianglebottom
bridge2crv_2 = Bridge2Crv(C_2=sortcurves.crv_15, C=sortcurves.crv_16, N=number_slider, close=toggle)  # -> Q, triangletop, trianglebottom
wbweave = WeaverbirdsMeshFromLinesWeaveBack(Lines=[bridge2crv.Q, bridge2crv_2.Q], MaximumValence=4)

# ----
wbfacepolys = WeaverbirdsFacePolylines(Mesh=wbweave)

# ==== cluster Bridge2Crv: Developed by Nono Martínez Alonso & Maria Mamoura @ Foster + Partners 150130
close = ClusterInput()
C = ClusterInput()
N = ClusterInput()
C_2 = ClusterInput()
bool = Boolean(close)
divide = DivideCurve(Curve=C_2, Count=N, Kinks=False)  # -> Points, Tangents, Parameters
divide_2 = DivideCurve(Curve=C, Count=N, Kinks=False)  # -> Points, Tangents, Parameters
item = ListItem(List=divide_2.Points, Index=0, Wrap=True)
item_2 = ListItem(List=divide_2.Points, Index=Slider(1, range=0..1), Wrap=True)
# Add first pt at the end
item_3 = ListItem(List=divide.Points, Index=0, Wrap=True)
pt = Point([item, item_2])
dispatch = Dispatch(List=item_3, DispatchPattern=bool)  # -> ListA, ListB
dispatch_2 = Dispatch(List=pt, DispatchPattern=bool)  # -> ListA, ListB
# Add first pt at the end
pt_2 = Point([divide_2.Points, dispatch_2.ListA])
pt_3 = Point([divide.Points, dispatch.ListA])
shift = ShiftList(List=pt_3, Shift=1, Wrap=True)
shift_2 = ShiftList(List=pt_2, Shift=1, Wrap=True)
ln = Line(StartPoint=pt_2, EndPoint=shift_2)
toggle = BooleanToggle(False)
curvepoint = PointOnCurve(ln, parameter=0.5)
# Create Top Closing Lines to avoid naked edges.
shift_3 = ShiftList(List=curvepoint, Shift=1, Wrap=True)
ln_2 = Line(StartPoint=shift_3, EndPoint=curvepoint)
rev = ReverseList(List=ln_2)
shift_4 = ShiftList(List=rev, Shift="2", Wrap=Toggle(False))
toggle_2 = BooleanToggle(False)
ln_3 = Line(StartPoint=shift, EndPoint=curvepoint)
pline = PolyLine(Vertices=pt_3, Closed=toggle)
pline_2 = PolyLine(Vertices=curvepoint, Closed=toggle)  # disabled
ln_4 = Line(StartPoint=pt_3, EndPoint=curvepoint)
crvtop = Curve(shift_4)
crvbottom = Curve(pline)
shift_5 = ShiftList(List=ln_4, Shift="-1", Wrap=toggle_2)
crvleft = Curve(shift_5)
shift_6 = ShiftList(List=ln_3, Shift="-1", Wrap=toggle_2)
crvright = Curve(shift_6)
toggle_3 = BooleanToggle(False)
join = JoinCurves(Curves=flatten([pline_2, pline, shift_6, shift_5, shift_4]), Preserve=False)
explode = Explode(Curve=crvtop, Recursive=True)  # -> Segments, Vertices
explode_2 = Explode(CrvBottom=crvbottom, Recursive=True)  # -> Segments, Vertices
explode_3 = Explode(Curve=join, Recursive=True)  # -> flatten(Segments), Vertices
panel = Panel("Remove Last Right")
panel_2 = Panel("Remove First Left")
crvbottom_2 = Curve(simplify(graft(explode_2.Segments)))
crvright_2 = Curve(simplify(graft(crvright)))
shift_7 = ShiftList(List=crvright, Shift="-1", Wrap=toggle_3)  # -> simplify(graft(CrvRight))
shift_8 = ShiftList(List=crvleft, Shift="1", Wrap=toggle_3)  # -> simplify(graft(CrvLeft))
crvleft_2 = Curve(simplify(graft(crvleft)))
crvtop_2 = Curve(simplify(graft(explode.Segments)))
dupln = RemoveDuplicateLines(Lines=explode_3.Segments, Tolerance=0.01)
panel_3 = Panel("Triangle A")
panel_4 = Panel("Triangle B")
Q = ClusterOutput(dupln)
join_2 = JoinCurves(Curves=[shift_7, shift_8], Preserve=False)  # -> reparameterize(simplify(Curves))
join_3 = JoinCurves(Curves=[crvright_2, crvleft_2, crvbottom_2], Preserve=False)  # -> simplify(Curves)
path_mapper = PathMapper(join_2, source="(A;B)", target="[A]")
path_mapper_2 = PathMapper(join_3, source="(A;B)", target="[A]")
flip = FlipMatrix(Data=path_mapper)
flip_2 = FlipMatrix(Data=path_mapper_2)
end = EndPoints(Curve=flip)  # -> Start, End
triangletop = ClusterOutput(flip_2)
ln_5 = Line(StartPoint=end.Start, EndPoint=end.End)
join_4 = JoinCurves(Curves=[ln_5, flip], Preserve=False)
trianglebottom = ClusterOutput(join_4)

# ==== cluster SortCurves: Developed by Nono Martínez Alonso & Maria Mamoura @ Foster + Partners 150130
crv = ClusterInput()
crv_2 = Curve(crv)
shift = ShiftList(List=crv_2, Shift=1, Wrap=Toggle(False))
dispatch = Dispatch(List=crv_2, DispatchPattern=[True, False])  # -> ListA, ListB
dispatch_2 = Dispatch(List=shift, DispatchPattern=[True, False])  # -> ListA, ListB
crv_3 = Curve(graft(dispatch.ListA))
crv_4 = Curve(graft(dispatch.ListB))
crv_5 = Curve(graft(dispatch_2.ListA))
crv_6 = Curve(graft(dispatch_2.ListB))
crv_7 = Curve(simplify([crv_3, crv_4]))
lng = ListLength(List=crv_7)
item = ListItem(List=crv_4, Index=0, Wrap=True)
crv_8 = Curve(simplify([crv_5, crv_6]))
lng_2 = ListLength(List=crv_8)
equals = Equality(FirstNumber=lng, SecondNumber="2")  # -> Equality, Inequality
equals_2 = Equality(FirstNumber=lng_2, SecondNumber="2")  # -> Equality, Inequality
dispatch_3 = Dispatch(List=crv_7, DispatchPattern=equals.Equality)  # -> flatten(ListA), ListB
dispatch_4 = Dispatch(List=crv_8, DispatchPattern=equals_2.Equality)  # -> flatten(ListA), ListB
dispatch_5 = Dispatch(List=dispatch_3.ListA, DispatchPattern=[True, False])  # -> ListA, ListB
dispatch_6 = Dispatch(List=dispatch_4.ListA, DispatchPattern=[True, False])  # -> ListA, ListB
crv_9 = Curve(dispatch_5.ListA)
crv_10 = Curve(dispatch_5.ListB)
crv_11 = Curve(dispatch_6.ListA)
crv_12 = Curve(dispatch_6.ListB)
crv_13 = ClusterOutput(crv_9)
crv_14 = ClusterOutput(crv_10)
crv_15 = ClusterOutput(crv_12)
crv_16 = ClusterOutput(crv_11)
