# Grasshopper definition InvertBoolean.gh (Grasshopper 0.9.76)

cluster = Cluster()

# ==== cluster Cluster
num = ClusterInput()
num_2 = Number(num)
subtraction = Subtraction(A=num_2, B=Slider(1, range=0..1))
abs = Absolute(Value=subtraction)
bool = Boolean(abs)
bool_2 = ClusterOutput(bool)
