# Grasshopper definition 141120_RandomSurface.gh (Grasshopper 0.9.14)

slider = Slider(5, range=0..10)
slider_2 = Slider(0, range=0..100)
slider_3 = Slider(56, range=0..100)
slider_4 = Slider(6, range=0..10)
slider_5 = Slider(0, range=0..100)
crv = Curve([<curve referenced from the Rhino model> x6])
crv_2 = Curve(<curve referenced from the Rhino model>)
dom = Domain(DomainStart=slider_2, DomainEnd=slider)
dom_2 = Domain(DomainStart=slider_5, DomainEnd=slider_4)
pln = Plane()
dom_3 = Domain(DomainStart=Slider(0, range=0..100), DomainEnd=Slider(7, range=0..10))
end = EndPoints(Curve=crv)  # -> Start, End
pt = PointXYZ(XComponent=slider, YComponent=slider_4, ZComponent=0, System=PlaneXY(0, 0, 0))
pt_2 = PointXYZ(XComponent=slider, YComponent=slider_2, ZComponent=0, System=PlaneXY(0, 0, 0))
pt_3 = PointXYZ(XComponent=slider_2, YComponent=slider_5, ZComponent=0, System=PlaneXY(0, 0, 0))
pt_4 = PointXYZ(XComponent=slider_2, YComponent=slider_4, ZComponent=0, System=PlaneXY(0, 0, 0))
random = Random(Range=dom, Number=slider_3, Seed=slider_3)
random_2 = Random(Range=dom_2, Number=slider_3, Seed=Slider(36, range=0..100))
random_3 = Random(Range=dom_3, Number=slider_3, Seed=Slider(80, range=0..100))
crv_cp = CurveCP(Point=end.Start, Curve=crv_2)  # -> Point, Parameter, Distance
crv_cp_2 = CurveCP(Point=end.End, Curve=crv_2)  # -> Point, Parameter, Distance
pt_5 = PointXYZ(XComponent=random, YComponent=random_2, ZComponent=random_3, System=PlaneXY(0, 0, 0))
dom_4 = Domain(DomainStart=crv_cp.Parameter, DomainEnd=crv_cp_2.Parameter)
pt_6 = Point(flatten([pt_4, pt_5, pt, pt_2, pt_3]))
subcrv = SubCurve(BaseCurve=crv_2, Domain=dom_4)
del = DelaunayMesh(Points=pt_6, Plane=PlaneXY(0, 0, 0))
pt_7 = Point(pt_3)
pt_8 = Point(pt_4)
Z = UnitZ(Factor=Slider(2.5, range=0..10))
extr = Extrude(Base=subcrv, Direction=Z)
ln = Line(StartPoint=pt_7, EndPoint=pt_8)
divide = DivideCurve(Curve=ln, Count=Slider(26, range=0..100), Kinks=False)  # -> Points, Tangents, Parameters
xz = XZPlane(Origin=pt_7)
vec2pt = Vector2Pt(PointA=pt_7, PointB=divide.Points, Unitize=False)  # -> Vector, Length
move = Move(Geometry=xz, Motion=vec2pt.Vector)  # -> Geometry, Transform
sec = MeshPlane(Mesh=del, Plane=move.Geometry)
reb = Rebuild(Curve=sec, Degree=Slider(3, range=0..10), Count=10, Tangents=False)
loft = Loft(Curves=flatten(reb), Options={Adjust=False, Closed=False, Rebuild=10, Refit=0.01, LoftType=0, LoftEnds=0, LoftSimp=0})
