# Grasshopper definition GADHelper_SelectFacesWithNormalToDirection.gh (Grasshopper 0.9.14)

crv = Curve(<curve referenced from the Rhino model>)
brep = Brep([<brep referenced from the Rhino model> x6])
crv_2 = Curve([<curve referenced from the Rhino model> x55])
slider = Slider(25, range=0..100)
end = EndPoints(Curve=crv)  # -> Start, End
end_2 = EndPoints(Curve=crv_2)  # -> Start, End
pt = Point(end.Start)
planar = PlanarSrf(Edges=crv_2)
pcomp = Decompose(Point=end_2.Start, System=PlaneXY(0, 0, 0))  # -> XComponent, YComponent, ZComponent
vec = Vector(crv)
abs = Absolute(Value=pcomp.YComponent)
Z = UnitZ(Factor=abs)
extr = Extrude(Base=planar, Direction=Z)
explode = BrepComponents(Brep=extr)  # -> flatten(Faces), Edges, Vertices
cluster = Cluster(srf=explode.Faces)
line = LineSDL(Start=pt, Direction=vec, Length=1)
crv_cp = CurveCP(Point=pt, Curve=line)  # -> Point, Parameter, Distance
end_3 = EndPoints(Curve=cluster)  # -> Start, End
vec2pt = Vector2Pt(PointA=pt, PointB=end_3.Start, Unitize=False)  # -> Vector, Length
pframe = PerpFrame(Curve=line, Parameter=crv_cp.Parameter)
move = Move(Geometry=pframe, Motion=vec2pt.Vector)  # -> Geometry, Transform
project = Project(Geometry=end_3.End, Plane=move.Geometry)  # -> Geometry, Transform
dist = Distance(PointA=end_3.Start, PointB=project.Geometry)
panel = Panel(dist)
smaller = SmallerThan(FirstNumber=dist, SecondNumber=Slider(0.74, range=0..1))  # -> SmallerThan, OrEqualTo
dispatch = Dispatch(List=explode.Faces, DispatchPattern=smaller.OrEqualTo)  # -> ListA, ListB
srf = Surface(dispatch.ListA)
area = Area(Geometry=srf)  # -> Area, Centroid
vec2pt_2 = Vector2Pt(PointA=pt, PointB=area.Centroid, Unitize=False)  # -> Vector, Length
cluster_2 = Cluster(srf=srf)
move_2 = Move(Geometry=pframe, Motion=vec2pt_2.Vector)  # -> Geometry, Transform
end_4 = EndPoints(Curve=cluster_2)  # -> Start, End
pcomp_2 = PlaneComponents(Plane=move_2.Geometry)  # -> Origin, XAxis, YAxis, ZAxis
line_2 = LineSDL(Start=pcomp_2.Origin, Direction=pcomp_2.ZAxis, Length=1)
end_5 = EndPoints(Curve=line_2)  # -> Start, End
dist_2 = Distance(PointA=end_4.End, PointB=end_5.End)
smaller_2 = SmallerThan(FirstNumber=dist_2, SecondNumber=Slider(0.65, range=0..1))  # -> SmallerThan, OrEqualTo
dispatch_2 = Dispatch(List=srf, DispatchPattern=smaller_2.OrEqualTo)  # -> ListA, ListB
srf_2 = Surface(flatten([dispatch_2.ListB, dispatch.ListB]))
panel_2 = Panel(dist_2)
srf_3 = Surface(dispatch_2.ListA)
preview = CustomPreview(Geometry=srf_2, Shader=ColourSwatch(SwatchColor=RGBA(255, 255, 255, 161)))
preview_2 = CustomPreview(Geometry=srf_3, Shader=ColourSwatch(SwatchColor=RGBA(0, 0, 0, 187)))

# ==== cluster Cluster
srf = ClusterInput()
srf_2 = Surface(srf)
area = Area(Geometry=srf_2)  # -> Area, Centroid
srf_cp = SurfaceCP(Point=area.Centroid, Surface=srf_2)  # -> Point, UVPoint, Distance
eval = EvaluateSurface(Surface=srf_2, Point=srf_cp.UVPoint)  # -> Point, Normal, Frame
line = LineSDL(Start=eval.Point, Direction=eval.Normal, Length="1")
L = ClusterOutput(line)
