# Grasshopper definition GADHelper_TerrainFromRLs.gh (Grasshopper 0.9.14)

crv_boundary = Curve(<curve referenced from the Rhino model>)
crv_rls = Curve([<curve referenced from the Rhino model> x13])
reb = Rebuild(Curve=crv_rls, Degree="2", Count=10, Tangents=False)
explode = Explode(Curve=crv_boundary, Recursive=True)  # -> Segments, Vertices
divide = DivideCurve(Curve=reb, Count=Slider(16, range=0..100), Kinks=False)  # -> flatten(Points), Tangents, Parameters
cls = Closed(Curve=reb)  # -> Closed, Periodic
item = ListItem(List=explode.Segments, Index=0, Wrap=False)
dispatch = Dispatch(List=reb, DispatchPattern=cls.Closed)  # -> ListA, flatten(ListB)
divide_2 = DivideCurve(Curve=item, Count=Slider(100, range=0..100), Kinks=False)  # -> Points, Tangents, Parameters
pframe = PerpFrame(Curve=item, Parameter=divide_2.Parameters)
end = EndPoints(Curve=dispatch.ListB)  # -> Start, End
pt = Point(flatten([end.Start, end.End]))
cp = ClosestPoint(Point=explode.Vertices, Cloud=pt)  # -> ClosestPoint, CPIndex, Distance
pcomp = Decompose(Point=cp.ClosestPoint, System=PlaneXY(0, 0, 0))  # -> XComponent, YComponent, ZComponent
Z = UnitZ(Factor=pcomp.ZComponent)
move = Move(Geometry=explode.Vertices, Motion=Z)  # -> Geometry, Transform
pt_2 = Point(flatten([divide.Points, move.Geometry]))
del = DelaunayMesh(Points=pt_2, Plane=PlaneXY(0, 0, 0))
sec = MeshPlane(Mesh=del, Plane=pframe)
reb_2 = Rebuild(Curve=sec, Degree=Slider(2, range=0..10), Count=Slider(30, range=0..1000), Tangents=False)  # -> flatten(Curve)
loft = Loft(Curves=reb_2, Options={Adjust=False, Closed=False, Rebuild=10, Refit=0.01, LoftType=0, LoftEnds=0, LoftSimp=0})
