# Grasshopper definition GADHelper_subCurve.gh (Grasshopper 0.9.14)

slider = Slider(1.61, range=0..10)
slider_2 = Slider(1.25, range=0..10)
crv = Curve(flatten([<curve referenced from the Rhino model> x2]))
cluster = Cluster(crv=crv, cropstartdistance=slider, cropenddistance=slider)

# ==== cluster Cluster
cropstartdistance = ClusterInput()
crv = ClusterInput()
crv_2 = Curve(crv)
cropenddistance = ClusterInput()
flip = Flip(Curve=crv_2)  # -> Curve, Flag
divlength = DivideLength(Curve=crv_2, Length=cropstartdistance)  # -> Points, Tangents, Parameters
divlength_2 = DivideLength(Curve=flip.Curve, Length=cropenddistance)  # -> Points, Tangents, Parameters
slider = Slider(1, range=0..1)
item = ListItem(List=divlength.Points, Index=slider, Wrap=False)  # -> flatten(Element)
item_2 = ListItem(List=divlength_2.Points, Index=slider, Wrap=False)  # -> flatten(Element)
crv_cp = CurveCP(Point=item, Curve=crv_2)  # -> Point, Parameter, Distance
crv_cp_2 = CurveCP(Point=item_2, Curve=crv_2)  # -> Point, Parameter, Distance
dom = Domain(DomainStart=crv_cp.Parameter, DomainEnd=crv_cp_2.Parameter)
subcrv = SubCurve(BaseCurve=crv_2, Domain=dom)
subcurve = ClusterOutput(subcrv)
