# Grasshopper definition GH_Revolution.gh (Grasshopper 0.9.14)

slider = Slider(43, range=0..100)
slider_2 = Slider(14, range=0..100)
pt = PointXYZ(XComponent=Slider(41, range=0..100), YComponent=Slider(41, range=0..100), ZComponent=slider, System=PlaneXY(0, 0, 0))
pt_2 = PointXYZ(XComponent=Slider(33, range=0..100), YComponent=Slider(0, range=0..100), ZComponent=slider, System=PlaneXY(0, 0, 0))
pt_3 = PointXYZ(XComponent=Slider(64, range=0..100), YComponent=Slider(53, range=0..100), ZComponent=slider, System=PlaneXY(0, 0, 0))
pt_4 = PointXYZ(XComponent=Slider(7, range=0..100), YComponent=Slider(54, range=0..100), ZComponent=slider, System=PlaneXY(0, 0, 0))
slider_3 = Slider(6, range=0..100)
pline = PolyLine(Vertices=[pt, pt_2, pt_4, pt_3], Closed=Toggle(True))
division = Division(A=Slider(360, range=0..1000), B=slider_3)
planar = PlanarSrf(Edges=pline)
xz = XZPlane(Origin=Point(0, 0, 0))
series = Series(Start=0, Step=slider_3, Count=division)
rotate = Rotate(Geometry=planar, Angle=degrees(series), Plane=xz)  # -> Geometry, Transform
panel = Panel(series)
preview = CustomPreview(Geometry=rotate.Geometry, Shader=ColourSwatch(SwatchColor=RGB(74, 111, 255)))
