# Grasshopper definition NOGrasshopperElementTree.gh (Grasshopper 0.9.62)
# Copyright: Nono 2014
# Copyright: Nono 2013
# plug-ins: LunchBox

boxheight = Slider(0.55, range=0..1)
treeheight = Slider(2.4, range=0..10)
panel = Panel("Tree")
xy = XYPlane(Origin=Point(0, 0, 0))
crv = Curve(<curve referenced from the Rhino model>)
amount = Slider(3, range=0..100)
boundary = BoundarySurfaces(Edges=crv)
num = Number(boxheight)
cluster = Cluster(plane=xy, X=Slider(0.78, range=0..1), Y=Slider(0.86, range=0..1))
boxheight_2 = Slider(0.55, range=0..1)
treeheight_2 = Slider(2.4, range=0..10)
peoplemaker = PeopleMaker(angle=Slider(148, range=0..360), surface=boundary, amount=amount, seed=Slider(37, range=0..100))
panel_3 = Panel("Soil")
panel_4 = Panel("Box")
panel_5 = Panel("Trunk")
panel_6 = Panel("Base Bottom")
cluster_2 = Cluster_2(crv=cluster, num=Slider(0.026, range=0..0.1))  # -> short, long
boundary_2 = BoundarySurfaces(Edges=cluster)
Z = UnitZ(Factor=treeheight)
cluster_3 = Cluster_3(X=Slider(0.78, range=0..1), Y=Slider(0.86, range=0..1), num=boxheight_2, num_2=treeheight_2)  # -> E_4, E_2, E_3, E
crv_2 = Curve(cluster_2.short)
area = Area(Geometry=crv_2)  # -> Area, Centroid
boundary_3 = BoundarySurfaces(Edges=crv_2)
move = Move(Geometry=area.Centroid, Motion=Z)  # -> Geometry, Transform
circle = CircleCNR(Center=area.Centroid, Normal=Vector(0, 0, 1), Radius=Slider(0.03, range=0..1))
subtraction = Subtraction(A=num, B=Slider(0.04, range=0..0.1))
geo = Geometry(cluster_3.E_4)
geo_2 = Geometry(cluster_3.E_2)
geo_3 = Geometry(cluster_3.E_3)
geo_4 = Geometry(cluster_3.E)
boundary_4 = BoundarySurfaces(Edges=flatten([cluster, crv_2]))
Z_2 = UnitZ(Factor=num)
Z_3 = UnitZ(Factor=subtraction)
boundary_5 = BoundarySurfaces(Edges=circle)
Z_4 = UnitZ(Factor=treeheight)
sph = Sphere(Base=move.Geometry, Radius=Slider(0.67, range=0..1))
popgeo = PopulateGeometry(Geometry=sph, Count=Slider(30, range=0..100), Seed=1)
shift = ShiftList(List=popgeo, Shift=1, Wrap=True)
ln = Line(StartPoint=popgeo, EndPoint=shift)
circle_2 = CircleCNR(Center=popgeo, Normal=ln, Radius=Slider(0.015, range=0..0.1))
boundary_6 = BoundarySurfaces(Edges=circle_2)
extrcrv = ExtrudeAlong(Base=boundary_6, Curve=ln)
extr = Extrude(Base=boundary_3, Direction=Z_3)
extr_2 = Extrude(Base=boundary_5, Direction=Z_4)
extr_3 = Extrude(Base=boundary_4, Direction=Z_2)
button = Button()

swatch = ColourSwatch(SwatchColor=RGB(255, 249, 179))
preview = CustomPreview(Geometry=extr_3, Shader=swatch)
bake = ObjectBake(BakeToggle=button, Layer="Render_TreeBox", ObjectName="GH_Obj", ObjectColor=swatch, LayerColor=RGB(255, 255, 255))

swatch_2 = ColourSwatch(SwatchColor=RGB(207, 131, 49))
preview_2 = CustomPreview(Geometry=extr, Shader=swatch_2)
bake_2 = ObjectBake(BakeToggle=button, Layer="Render_TreeSoil", ObjectName="GH_Obj", ObjectColor=swatch_2, LayerColor=RGB(255, 255, 255))

# ==== cluster Cluster
plane = ClusterInput()
X = ClusterInput()
Y = ClusterInput()
pln = Plane(plane)
number_slider = Slider(0.5, range=0..1)
deplane = DeconstructPlane(Plane=pln)  # -> Origin, XAxis, YAxis, ZAxis
multiplication = Multiplication(A=X, B=number_slider)
multiplication_2 = Multiplication(A=Y, B=number_slider)
multiplication_3 = Multiplication(A=deplane.XAxis, B=multiplication)
multiplication_4 = Multiplication(A=deplane.YAxis, B=multiplication_2)
rectangle = Rectangle(Plane=pln, XSize=X, YSize=Y, Radius=0)  # -> Rectangle, Length
addition = Addition(A=multiplication_3, B=multiplication_4)
neg = Negative(Value=addition)
move = Move(Geometry=rectangle.Rectangle, Motion=neg)  # -> Geometry, Transform
crv = ClusterOutput(move.Geometry)

# ==== cluster Cluster_2
num = ClusterInput()
crv = ClusterInput()
num_2 = Number(num)
crv_2 = Curve(crv)
offset = Offset(Curve=crv_2, Distance=expr("-d", num_2), Plane=PlaneXY(0, 0, 0), Corners=1)
offset_2 = Offset(Curve=crv_2, Distance=num_2, Plane=PlaneXY(0, 0, 0), Corners=1)
len = Length(Curve=offset_2)
len_2 = Length(Curve=offset)
larger = LargerThan(FirstNumber=len, SecondNumber=len_2)  # -> LargerThan, OrEqualTo
larger_2 = LargerThan(FirstNumber=len_2, SecondNumber=len)  # -> LargerThan, OrEqualTo
dispatch = Dispatch(List=offset_2, DispatchPattern=larger.LargerThan)  # -> ListA, ListB
dispatch_2 = Dispatch(List=offset, DispatchPattern=larger_2.LargerThan)  # -> ListA, ListB
geo = Geometry([dispatch.ListB, dispatch_2.ListB])
geo_2 = Geometry([dispatch.ListA, dispatch_2.ListA])
short = ClusterOutput(geo)
long = ClusterOutput(geo_2)

# ==== cluster PeopleMaker
surface = ClusterInput()
angle = ClusterInput()
amount = ClusterInput()
crv = Curve(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)
pt = ConstructPoint(XCoordinate=0, YCoordinate=0, ZCoordinate=0)
seed = ClusterInput()
rotate = Rotate(Geometry=crv, Angle=degrees(angle), Plane=PlaneXY(0, 0, 0))  # -> Geometry, Transform
popgeo = PopulateGeometry(Geometry=surface, Count=amount, Seed=seed)
vec2pt = Vector2Pt(PointA=pt, PointB=popgeo, Unitize=False)  # -> Vector, Length
move = Move(Geometry=rotate.Geometry, Motion=vec2pt.Vector)  # -> Geometry, Transform
people = ClusterOutput(move.Geometry)

# ==== cluster Cluster_3
X = ClusterInput()
Y = ClusterInput()
num = ClusterInput()
num_2 = ClusterInput()
num_3 = Number(num_2)
num_4 = Number(num)
xy = XYPlane(Origin=Point(0, 0, 0))
cluster = Cluster(plane=xy, X=X, Y=Y)
panel = Panel("Soil")
panel_2 = Panel("Box")
panel_3 = Panel("Trunk")
panel_4 = Panel("Base Bottom")
cluster_2 = Cluster_2(crv=cluster, num=Slider(0.026, range=0..0.1))  # -> short, long
boundary = BoundarySurfaces(Edges=cluster)
Z = UnitZ(Factor=num_3)
crv = Curve(cluster_2.short)
area = Area(Geometry=crv)  # -> Area, Centroid
boundary_2 = BoundarySurfaces(Edges=crv)
move = Move(Geometry=area.Centroid, Motion=Z)  # -> Geometry, Transform
circle = CircleCNR(Center=area.Centroid, Normal=Vector(0, 0, 1), Radius=Slider(0.03, range=0..1))
subtraction = Subtraction(A=num_4, B=Slider(0.04, range=0..0.1))
boundary_3 = BoundarySurfaces(Edges=flatten([cluster, crv]))
Z_2 = UnitZ(Factor=num_4)
Z_3 = UnitZ(Factor=subtraction)
boundary_4 = BoundarySurfaces(Edges=circle)
Z_4 = UnitZ(Factor=num_3)
sph = Sphere(Base=move.Geometry, Radius=Slider(0.67, range=0..1))
popgeo = PopulateGeometry(Geometry=sph, Count=Slider(30, range=0..100), Seed=1)
shift = ShiftList(List=popgeo, Shift=1, Wrap=True)
ln = Line(StartPoint=popgeo, EndPoint=shift)
circle_2 = CircleCNR(Center=popgeo, Normal=ln, Radius=Slider(0.015, range=0..0.1))
boundary_5 = BoundarySurfaces(Edges=circle_2)
extrcrv = ExtrudeAlong(Base=boundary_5, Curve=ln)
E = ClusterOutput(extrcrv)
extr = Extrude(Base=boundary_2, Direction=Z_3)
E_2 = ClusterOutput(extr)
extr_2 = Extrude(Base=boundary_4, Direction=Z_4)
E_3 = ClusterOutput(extr_2)
extr_3 = Extrude(Base=boundary_3, Direction=Z_2)
E_4 = ClusterOutput(extr_3)
