# Grasshopper definition RoadLines.gh (Grasshopper 0.9.76)
# Copyright: Nono 2014

pipeline = GeometryPipeline(
    GroupByLayer=False,
    GroupByType=False,
    IncludeHidden=True,
    IncludeLocked=True,
    LayerFilter="REF_Road",
    NameFilter="*",
    TypeFilter=4)
crv = Curve(graft(pipeline))
pt = ConstructPoint(XCoordinate=Slider(15, range=0..100), YCoordinate=0, ZCoordinate=0)
divdist = DivideDistance(Curve=crv, Distance=Slider(0.5, range=0..10))  # -> Points, Tangents, Parameters
split = TextSplit(Text="1,1,1,0,0,0,0,0", Separators=",")
shatter = Shatter(Curve=crv, Parameters=divdist.Parameters)
intcrv_t = InterpolateT(Vertices=pt, Degree=3, TangentStart=Vector(0, 0, 0), TangentEnd=Vector(0, 0, 0), KnotStyle=1)  # -> Curve, Length, Domain
dispatch = Dispatch(List=shatter, DispatchPattern=split)  # -> ListA, ListB
offset = Slider(0.1, range=0..1)
join = JoinCurves(Curves=dispatch.ListA, Preserve=False)
cluster = Cluster(crv=join, num=offset)  # -> short, long
shortoffset = Curve(cluster.short)
longoffset = Curve(cluster.long)
end = EndPoints(Curve=longoffset)  # -> Start, End
end_2 = EndPoints(Curve=shortoffset)  # -> Start, End
ln = Line(StartPoint=end_2.End, EndPoint=end.End)
ln_2 = Line(StartPoint=end_2.Start, EndPoint=end.Start)
join_2 = JoinCurves(Curves=simplify([ln_2, ln, shortoffset, longoffset]), Preserve=False)  # -> flatten(Curves)
boundary = BoundarySurfaces(Edges=join_2)  # disabled

# ==== cluster Cluster
num = ClusterInput()
crv = ClusterInput()
num_2 = Number(num)
crv_2 = Curve(crv)
offset = Offset(Curve=crv_2, Distance=expr("-x", num_2), Plane=PlaneXY(0, 0, 0), Corners=1)
offset_2 = Offset(Curve=crv_2, Distance=num_2, Plane=PlaneXY(0, 0, 0), Corners=1)
len = Length(Curve=offset_2)
len_2 = Length(Curve=offset)
larger = LargerThan(FirstNumber=len, SecondNumber=len_2)  # -> LargerThan, OrEqualTo
larger_2 = LargerThan(FirstNumber=len_2, SecondNumber=len)  # -> LargerThan, OrEqualTo
dispatch = Dispatch(List=offset_2, DispatchPattern=larger.LargerThan)  # -> ListA, ListB
dispatch_2 = Dispatch(List=offset, DispatchPattern=larger_2.LargerThan)  # -> ListA, ListB
geo = Geometry([dispatch.ListB, dispatch_2.ListB])
geo_2 = Geometry([dispatch.ListA, dispatch_2.ListA])
short = ClusterOutput(geo)
long = ClusterOutput(geo_2)
