# Grasshopper definition SinControlCurve.gh (Grasshopper 0.9.76)

series = Series(Start=0, Step=Slider(0.62, range=0..1), Count=Slider(22, range=0..100))
pi = Pi(Factor=1)
pt = ConstructPoint(XCoordinate=series, YCoordinate=0, ZCoordinate=0)
lng = ListLength(List=flatten(pt))
multiplication = Multiplication(A=pi, B=Slider(0.08, range=0..1))
series_2 = Series(Start=0, Step=multiplication, Count=lng)  # -> flatten(Series)
number_slider = Slider(0.2, range=0..1)
sin = Sine(Value=series_2)  # -> flatten(Result)
num = Number(sin)
neg = Negative(Value=number_slider)
multiplication_2 = Multiplication(A=Slider(0.56, range=0..1), B=sin)  # -> flatten(Result)
number_slider_2 = Slider(0.84, range=0..1)
smaller = SmallerThan(FirstNumber=num, SecondNumber=neg)  # -> SmallerThan, OrEqualTo
dispatch = Dispatch(List=num, DispatchPattern=smaller.SmallerThan)  # -> ListA, ListB
index = ItemIndex(List=num, Item=dispatch.ListA)
multiplication_3 = Multiplication(A=neg, B=number_slider_2)
multiplication_4 = Multiplication(A=number_slider, B=number_slider_2)
replace = ReplaceItems(List=num, Item=multiplication_3, Indices=index, Wrap=False)
larger = LargerThan(FirstNumber=replace, SecondNumber=number_slider)  # -> LargerThan, OrEqualTo
dispatch_2 = Dispatch(List=replace, DispatchPattern=larger.LargerThan)  # -> ListA, ListB
index_2 = ItemIndex(List=replace, Item=dispatch_2.ListA)
replace_2 = ReplaceItems(List=replace, Item=multiplication_4, Indices=index_2, Wrap=False)
heightvalues = Number(replace_2)
Y = UnitY(Factor=heightvalues)
move = Move(Geometry=pt, Motion=Y)  # -> Geometry, Transform
intcrv = Interpolate(Vertices=move.Geometry, Degree=3, Periodic=False, KnotStyle=1)  # -> Curve, Length, Domain
