# Grasshopper definition SubCurves_forPepe.gh (Grasshopper 0.9.76)

crv = Curve(<curve referenced from the Rhino model>)
curvepoint = PointOnCurve(crv, parameter=0.295)
curvepoint_2 = PointOnCurve(crv, parameter=0.567)
# Create a SubCurve between to points
crv_2 = Curve(crv)
pt = Point(curvepoint_2)
pt_2 = Point(curvepoint)
# Shatter a curve in fragments
crv_3 = Curve(crv)
pt_3 = Point(curvepoint_2)
pt_4 = Point(curvepoint)
crv_cp = CurveClosestPoint(Point=pt, Curve=crv_2)  # -> Point, Parameter, Distance
crv_cp_2 = CurveClosestPoint(Point=pt_2, Curve=crv_2)  # -> Point, Parameter, Distance
crv_cp_3 = CurveClosestPoint(Point=pt_3, Curve=crv_3)  # -> Point, Parameter, Distance
crv_cp_4 = CurveClosestPoint(Point=pt_4, Curve=crv_3)  # -> Point, Parameter, Distance
dom = ConstructDomain(DomainStart=crv_cp_2.Parameter, DomainEnd=crv_cp.Parameter)
shatter = Shatter(Curve=crv_3, Parameters=[crv_cp_4.Parameter, crv_cp_3.Parameter])
subcrv = SubCurve(BaseCurve=crv_2, Domain=dom)
panel = Panel(shatter)
item = ListItem(List=shatter, Index=Slider(1, range=0..1), Wrap=True)
