# Grasshopper definition Util_StairsFromPlanSteps.gh (Grasshopper 0.9.62)
# Copyright: Nono 2014

floorheight = Slider(2.3, range=0..10)
baseheight = Slider(3, range=0..10)
crv = Curve(graft([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]))
crv_2 = Curve(graft([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]))
crv_3 = Curve(graft([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]))
cluster = Cluster(graftedoutlines=[crv_3, crv_2], base=baseheight, height=floorheight)

# ==== cluster Cluster
base = ClusterInput()  # Floor height from floor level to floor level.
graftedoutlines = ClusterInput()
height = ClusterInput()  # Floor height from floor level to floor level.
Z = UnitZ(Factor=base)
move = Move(Geometry=graftedoutlines, Motion=Z)  # -> Geometry, Transform
crv = Curve(move.Geometry)
flip = FlipMatrix(Data=crv)
null = NullItem(Item=flip)  # -> NullFlags, InvalidFlags, Description
dispatch = Dispatch(List=flip, DispatchPattern=null.NullFlags)  # -> ListA, ListB
lng = ListLength(List=dispatch.ListB)
division = Division(A=height, B=lng)
series = Series(Start=division, Step=division, Count=lng)
Z_2 = UnitZ(Factor=series)
move_2 = Move(Geometry=flip, Motion=Z_2)  # -> Geometry, Transform
boundary = BoundarySurfaces(Edges=move_2.Geometry)
srf = ClusterOutput(boundary)
