# Grasshopper definition NOGrasshopperUtil.gh (Grasshopper 0.9.62)
# Copyright: Nono 2013
# Copyright: Nono 2014

# PEOPLE: Populate Surface With Amount, Angle
number_slider = Slider(148, range=0..360)
crv = Curve(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)
amount = Slider(9, range=0..100)
# BUILDING: Inclined Roof With Crvs, Z, Height
number_slider_2 = Slider(37, range=0..100)
# CRV: Line With Center, Direction, Length
pt = ConstructPoint(XCoordinate=0, YCoordinate=0, ZCoordinate=0)
# SRF: Solid With Outline, Base Z, Height
crv_2 = Curve(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)
thickness = Slider(0.005, range=0..0.01)
# CRV: Thicken With Offset Thickness
crv_3 = Curve(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)
# NOGrasshopperUtil
# 
# Developed by Nono Martínez Alonso (@nonoesp)
# LIST: Remove List Extremes
panel = Panel("1,2,3,4,5,6,7")
boundary = BoundarySurfaces(Edges=crv)
crv_4 = Curve([<curve referenced from the Rhino model> x3])
crv_5 = Curve([<curve referenced from the Rhino model> x3])
split = TextSplit(Text=panel, Separators=",")

start = Slider(1, range=0..10)
end = Slider(1, range=0..10)
remove_extremes = RemoveExtremes(list=split, start=start, end=end)
peoplemaker = PeopleMaker(angle=number_slider, surface=boundary, amount=amount, seed=number_slider_2)
cluster = Cluster_4(basecrvs=crv_4, topcrvs=crv_5, Z=Slider(8.57, range=0..30), height=Slider(3.445, range=0..10))
cluster_2 = Cluster(center=pt, direction=Vector(0, 0, 1), length=Slider(0.06, range=0..0.1))
cluster_3 = Cluster_3(outline=crv_2, start=Slider(3.15, range=0..10), height=Slider(2.55, range=0..10))
# Needs to be separated from polyline to end points with lines, because when there are more than 2 curves it messes up.
cluster_4 = Cluster_2(crv=crv_3, D=thickness)

panel_2 = Panel(remove_extremes)
# CRV: Thicken With Offset Thickness (Thicken from center)
number_slider_3 = Slider(0.03, range=0..0.1)
crv_6 = Curve(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)
cluster_5 = Cluster_5(crv=crv_6, num=number_slider_3)

# ==== cluster RemoveExtremes
end = ClusterInput()
start = ClusterInput()
list = ClusterInput()
lng = ListLength(List=list)
subtraction = Subtraction(A=lng, B=Slider(1, range=0..10))
subtraction_2 = Subtraction(A=subtraction, B=end)
dom = ConstructDomain(DomainStart=start, DomainEnd=subtraction_2)
subset = SubList(List=list, Domain=dom, Wrap=True)  # -> List, Index
sublist = ClusterOutput(subset.List)

# ==== cluster Cluster
center = ClusterInput()
direction = ClusterInput()
length = ClusterInput()
division = Division(A=length, B="2")
neg = Negative(Value=division)
line = LineSDL(Start=graft(center), Direction=direction, Length=[division, neg])  # -> flatten(Line)
join = JoinCurves(Curves=line, Preserve=False)
C = ClusterOutput(join)

# ==== cluster Cluster_2
crv = ClusterInput()
D = ClusterInput()
crv_2 = Curve(crv)
offset = Offset(Curve=crv_2, Distance=D, Plane=PlaneXY(0, 0, 0), Corners=1)
end = EndPoints(Curve=[offset, crv_2])  # -> Start, End
pline = PolyLine(Vertices=flatten(end.End), Closed=False)
pline_2 = PolyLine(Vertices=flatten(end.Start), Closed=False)
join = JoinCurves(Curves=[pline_2, offset, pline, crv_2], Preserve=False)
C = ClusterOutput(join)

# ==== cluster Cluster_3
height = ClusterInput()
start = ClusterInput()
outline = ClusterInput()
Z = UnitZ(Factor=start)
Z_2 = UnitZ(Factor=height)
move = Move(Geometry=outline, Motion=Z)  # -> Geometry, Transform
boundary = BoundarySurfaces(Edges=move.Geometry)
extr = Extrude(Base=boundary, Direction=Z_2)
solid = ClusterOutput(extr)

# ==== cluster PeopleMaker
surface = ClusterInput()
angle = ClusterInput()
amount = ClusterInput()
crv = Curve(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)
pt = ConstructPoint(XCoordinate=0, YCoordinate=0, ZCoordinate=0)
seed = ClusterInput()
rotate = Rotate(Geometry=crv, Angle=degrees(angle), Plane=PlaneXY(0, 0, 0))  # -> Geometry, Transform
popgeo = PopulateGeometry(Geometry=surface, Count=amount, Seed=seed)
vec2pt = Vector2Pt(PointA=pt, PointB=popgeo, Unitize=False)  # -> Vector, Length
move = Move(Geometry=rotate.Geometry, Motion=vec2pt.Vector)  # -> Geometry, Transform
people = ClusterOutput(move.Geometry)

# ==== cluster Cluster_4
topcrvs = ClusterInput()
height = ClusterInput()
basecrvs = ClusterInput()
Z = ClusterInput()
crv = Curve(graft(topcrvs))
crv_2 = Curve(graft(basecrvs))
addition = Addition(A=Z, B=height)
Z_2 = UnitZ(Factor=addition)
Z_3 = UnitZ(Factor=Z)
move = Move(Geometry=crv, Motion=Z_3)  # -> Geometry, Transform
move_2 = Move(Geometry=crv_2, Motion=Z_2)  # -> Geometry, Transform
move_3 = Move(Geometry=crv_2, Motion=Z_3)  # -> Geometry, Transform
loft_opt = LoftOptions(Closed=False, Adjust=False, Rebuild=0, Refit=0, Type=Slider(3, range=0..10))
geo = Geometry(move_2.Geometry)
loft = Loft(Curves=[move_2.Geometry, move_3.Geometry, move.Geometry, geo], Options=loft_opt)
cap = CapHoles(Brep=loft)
roof = ClusterOutput(cap)

# ==== cluster Cluster_5
num = ClusterInput()
crv = ClusterInput()
num_2 = Number(num)
crv_2 = Curve(crv)
offset = Offset(Curve=crv_2, Distance=num_2, Plane=PlaneXY(0, 0, 0), Corners=1)
neg = Negative(Value=num_2)
offset_2 = Offset(Curve=crv_2, Distance=neg, Plane=PlaneXY(0, 0, 0), Corners=1)
end = EndPoints(Curve=offset)  # -> Start, End
end_2 = EndPoints(Curve=offset_2)  # -> Start, End
ln = Line(StartPoint=end.Start, EndPoint=end_2.Start)
ln_2 = Line(StartPoint=end.End, EndPoint=end_2.End)
join = JoinCurves(Curves=[ln, ln_2, offset, offset_2], Preserve=False)
C = ClusterOutput(join)
