# Grasshopper definition GADCurveListIntersect.gh (Grasshopper 0.9.76)

crv = Curve([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])

# ---- group: CurveListIntersect
crvlistx = CrvListX(crv=crv)  # -> pt_2, ta_2, tb_2

# ---- group: Sample Use
shatter = Shatter(Curve=simplify(graft(crv)), Parameters=crvlistx.ta_2)
curvepoint = PointOnCurve(shatter, parameter=0.5)
scale = Scale(Geometry=shatter, Center=curvepoint, Factor=Slider(0.69, range=0..1))  # -> Geometry, Transform

# ==== cluster CrvListX
crv = ClusterInput()

crv_2 = Curve(crv)
explode = Explode(Curve=crv_2, Recursive=True)  # -> Segments, Vertices
flatten = FlattenTree(Tree=explode.Segments, Path="{0}")
graft = GraftTree(Tree=flatten, IncludeEmptyLists=True, IncludeNullItems=True)
simplify = SimplifyTree(Tree=graft, Front=False)
crv_3 = Curve(simplify)

# ---- group: Create Intersectable Lists (Without the intersecting curve)
index = ItemIndex(List=flatten(crv_3), Item=flatten(crv_3))  # -> graft(Index)
replace = ReplaceItems(List=flatten(crv_3), Indices=index, Wrap=False)  # -> simplify(List)
ccx = CurveCurve(CurveA=crv_3, CurveB=replace)  # -> simplify(Points), simplify(ParamsA), simplify(ParamsB)

# ---- group: Clean Output
path_mapper = PathMapper(ccx.ParamsA, source="{A;B}", target="{A}")
path_mapper_2 = PathMapper(ccx.Points, source="{A;B}", target="{A}")
path_mapper_3 = PathMapper(ccx.ParamsB, source="{A;B}", target="{A}")
pt = Point(path_mapper_2)
tb = Number(path_mapper_3)
ta = Number(path_mapper)

# ----
pt_2 = ClusterOutput(pt)
tb_2 = ClusterOutput(tb)
ta_2 = ClusterOutput(ta)
