# Grasshopper definition GADMeshFromCurve.gh (Grasshopper 0.9.76)

# Triangulated or cuadrangulated curve list
crv = Curve([<curve referenced from the Rhino model> x6])
panel = Panel("Requires WeaverBird + Kangaroo")
M = M(C=crv)

# ==== cluster M
C = ClusterInput()
explode = Explode(Curve=C, Recursive=True)  # -> flatten(Segments), Vertices
dupln = RemoveDuplicateLines(Lines=explode.Segments, Tolerance=0.01)
wbweave = WeaverbirdsMeshFromLinesWeaveBack(Lines=dupln, MaximumValence=4)
mesh = Mesh(wbweave)
mesh_2 = ClusterOutput(mesh)
