# Grasshopper definition GADSurfaceSplitWithFlatCurve.gh (Grasshopper 0.9.76)

srf = Surface(<surface referenced from the Rhino model>)
crv = Curve(<curve referenced from the Rhino model>)
split = Split(G=srf, C=crv)  # -> geo_small_2, geo_large_2
small_srf = Geometry(split.geo_small_2)
large_srf = Geometry(split.geo_large_2)

# ==== cluster Split
G = ClusterInput()
C = ClusterInput()  # Planar curve outline to split with.
outline_crv = Curve(C)
G_2 = Geometry(G)
boundary = BoundarySurfaces(Edges=outline_crv)
Z = UnitZ(Factor=1)
extcenter = ExtCenter(G=boundary, D=Z, L="999")
split = SplitBrep(Brep=G_2, Cutter=extcenter)
area = Area(Geometry=split)  # -> Area, Centroid
sort = SortList(Keys=area.Area, ValuesA=split)  # -> Keys, ValuesA
item = ListItem(List=reverse(sort.ValuesA), Index=0, Wrap=True)
item_2 = ListItem(List=sort.ValuesA, Index=0, Wrap=True)
geo_small = Geometry(item_2)
geo_large = Geometry(item)
geo_small_2 = ClusterOutput(geo_small)
geo_large_2 = ClusterOutput(geo_large)

# ==== cluster ExtCenter
D = ClusterInput()
L = ClusterInput()
G = ClusterInput()
vec = Vector(D)
multiplication = Multiplication(Vec=vec, B=L)
extr = Extrude(Base=G, Direction=multiplication)
neg = Negative(Value=multiplication)
multiplication_2 = Multiplication(A=neg, B="0.5")
move = Move(Geometry=extr, Motion=multiplication_2)  # -> Geometry, Transform
geo = Geometry(move.Geometry)
geo_2 = ClusterOutput(geo)
