# Grasshopper definition _GADGeometrySorter.gh (Grasshopper 0.9.76)

# A series of sorters of different kinds of geometries (curves, surfaces, points) with different parameters (length, coordinates, areas, volumes).
panel = Panel("Curves")
bylength = ByLength()  # -> shorter_crv_2, longer_crv_2, sorted_list
bymidxyz = ByMidXYZ()  # -> X, Y, Z
panel_2 = Panel("Surfaces")
sort = Sort()  # -> X_2, Y_2, Z_2
panel_3 = Panel("Points")
bycenter = ByCenter()  # -> X, Y, Z
panel_4 = Panel("Generic")
byarea = ByArea()

# ==== cluster ByLength
crv = ClusterInput()
crv_2 = Curve(crv)
join = JoinCurves(Curves=crv_2, Preserve=False)
len = Length(Curve=join)
sort = SortList(Keys=len, ValuesA=join)  # -> Keys, ValuesA
rev = ReverseList(List=sort.ValuesA)
item = ListItem(List=sort.ValuesA, Index=0, Wrap=True)
item_2 = ListItem(List=rev, Index=0, Wrap=True)
shorter_crv = Curve(item)
longer_crv = Curve(item_2)
shorter_crv_2 = ClusterOutput(shorter_crv)
longer_crv_2 = ClusterOutput(longer_crv)
sorted_list = ClusterOutput(sort.ValuesA)

# ==== cluster ByMidXYZ
crv = ClusterInput()
crv_2 = Curve(crv)
curvepoint = PointOnCurve(crv_2, parameter=0.5)
pdecon = Deconstruct(Point=curvepoint)  # -> XComponent, YComponent, ZComponent
pdecon_2 = Deconstruct(Point=curvepoint)  # -> XComponent, YComponent, ZComponent
pdecon_3 = Deconstruct(Point=curvepoint)  # -> XComponent, YComponent, ZComponent
sort = SortList(Keys=pdecon.XComponent, ValuesA=crv_2)  # -> Keys, ValuesA
sort_2 = SortList(Keys=pdecon_2.YComponent, ValuesA=crv_2)  # -> Keys, ValuesA
sort_3 = SortList(Keys=pdecon_3.ZComponent, ValuesA=crv_2)  # -> Keys, ValuesA
X = ClusterOutput(sort.ValuesA)
Y = ClusterOutput(sort_2.ValuesA)
Z = ClusterOutput(sort_3.ValuesA)

# ==== cluster Sort
pt = ClusterInput()
pt_2 = Point(pt)
pdecon = Deconstruct(Point=pt_2)  # -> XComponent, YComponent, ZComponent
pdecon_2 = Deconstruct(Point=pt_2)  # -> XComponent, YComponent, ZComponent
pdecon_3 = Deconstruct(Point=pt_2)  # -> XComponent, YComponent, ZComponent
sort = SortList(Keys=pdecon_2.XComponent, ValuesA=pt_2)  # -> Keys, ValuesA
sort_2 = SortList(Keys=pdecon.YComponent, ValuesA=pt_2)  # -> Keys, ValuesA
sort_3 = SortList(Keys=pdecon_3.ZComponent, ValuesA=pt_2)  # -> Keys, ValuesA
X = Point(sort.ValuesA)
Y = Point(sort_2.ValuesA)
Z = Point(sort_3.ValuesA)
X_2 = ClusterOutput(X)
Y_2 = ClusterOutput(Y)
Z_2 = ClusterOutput(Z)

# ==== cluster ByArea
geo = ClusterInput()
geo_2 = Geometry(geo)
area = Area(Geometry=geo_2)  # -> Area, Centroid
sort = SortList(Keys=area.Area, ValuesA=geo_2)  # -> Keys, ValuesA
A = ClusterOutput(sort.ValuesA)

# ==== cluster ByCenter
srf = ClusterInput()
srf_2 = Surface(srf)
area = Area(Geometry=srf_2)  # -> Area, Centroid
pdecon = Deconstruct(Point=area.Centroid)  # -> XComponent, YComponent, ZComponent
pdecon_2 = Deconstruct(Point=area.Centroid)  # -> XComponent, YComponent, ZComponent
pdecon_3 = Deconstruct(Point=area.Centroid)  # -> XComponent, YComponent, ZComponent
sort = SortList(Keys=pdecon.XComponent, ValuesA=srf_2)  # -> Keys, ValuesA
sort_2 = SortList(Keys=pdecon_2.YComponent, ValuesA=srf_2)  # -> Keys, ValuesA
sort_3 = SortList(Keys=pdecon_3.ZComponent, ValuesA=srf_2)  # -> Keys, ValuesA
X = ClusterOutput(sort.ValuesA)
Y = ClusterOutput(sort_2.ValuesA)
Z = ClusterOutput(sort_3.ValuesA)
