# Grasshopper definition CrossFillet_forPepe.gh (Grasshopper 0.9.76)

crv = Curve([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])
runion = RegionUnion(Curves=crv)
explode = Explode(Curve=runion, Recursive=True)  # -> Segments, Vertices; disabled
area = Area(Geometry=runion)  # -> Area, Centroid
curvepoint = PointOnCurve(explode.Segments, parameter=0.5)
dist = Distance(PointA=area.Centroid, PointB=curvepoint)
sort = SortList(Keys=dist, ValuesA=explode.Segments)  # -> Keys, ValuesA
dom = ConstructDomain(DomainStart=Slider(0, range=0..100), DomainEnd=Slider(7, range=0..10))
subset = SubList(List=sort.ValuesA, Domain=dom, Wrap=True)  # -> List, Index
join = JoinCurves(Curves=subset.List, Preserve=False)
fillet = FilletDistance(Curve=join, Distance=Slider(1.19, range=0..10))
