# Grasshopper definition Curve-Superposition.gh (Grasshopper 0.9.76)

number_slider = Slider(26, range=0..100)
crv = Curve(<curve referenced from the Rhino model>)
divide = DivideCurve(Curve=crv, Count=number_slider, Kinks=False)  # -> Points, Tangents, Parameters
range = Range(Domain=Domain(0, 1), Steps=number_slider)
graph = GraphMapper(range, x0=0, x1=1, y0=0, y1=1, container_name="Bezier", cpx=[0, 0.6974192262, 0.6548388004, 1], cpy=[0, 0, 1, 1])
graph_2 = GraphMapper(range, x0=0, x1=1, y0=0, y1=1, container_name="Bezier", cpx=[0, 0, 0, 1], cpy=[0, 1, 1, 1])
multiplication = Multiplication()
num = Number(graft(graph))
num_2 = Number(graft(graph_2))
multiplication_2 = Multiplication(A=num, B=Slider(2.72, range=0..10))
flatten = FlattenTree(Tree=num_2, Path="{0}")
multiplication_3 = Multiplication()
addition = Addition(A=multiplication_2, B=num_2)  # -> flatten(Result)
panel = Panel(addition)
panel_2 = Panel(flatten)
Z = UnitZ(Factor=addition)
move = Move(Geometry=divide.Points, Motion=Z)  # -> Geometry, Transform
intcrv = Interpolate(Vertices=move.Geometry, Degree=3, Periodic=False, KnotStyle=1)  # -> Curve, Length, Domain
