# Grasshopper definition CurveLacer.gh (Grasshopper 0.9.76)

crv = Curve([<curve referenced from the Rhino model> x6])
shifter = Shifter(L_2=crv, L=crv)  # -> L_4, L_3
divide = DivideCurve(Curve=shifter.L_3, Count=10, Kinks=False)  # -> simplify(Points), Tangents, Parameters
divide_2 = DivideCurve(Curve=shifter.L_4, Count=10, Kinks=False)  # -> simplify(Points), Tangents, Parameters
shifter_2 = Shifter_2(L=divide_2.Points, L_2=divide.Points)  # -> L_3, L_4
shifter_3 = Shifter_2(L=divide.Points, L_2=divide_2.Points)  # -> L_3, L_4
ln = Line(StartPoint=shifter_3.L_3, EndPoint=shifter_3.L_4)
ln_2 = Line(StartPoint=shifter_2.L_3, EndPoint=shifter_2.L_4)

# ==== cluster Shifter
L = ClusterInput()
L_2 = ClusterInput()
shift = ShiftList(List=L, Shift=1, Wrap=Toggle(False))
L_3 = ClusterOutput(shift)
lng = ListLength(List=shift)
dom = ConstructDomain(DomainStart=0, DomainEnd=expr("x-1", lng))
subset = SubList(List=L_2, Domain=dom, Wrap=True)  # -> List, Index
L_4 = ClusterOutput(subset.List)

# ==== cluster Shifter_2
L = ClusterInput()
L_2 = ClusterInput()
shift = ShiftList(List=L_2, Shift=1, Wrap=Toggle(False))
lng = ListLength(List=shift)
dom = ConstructDomain(DomainStart=0, DomainEnd=expr("x-1", lng))
subset = SubList(List=L, Domain=dom, Wrap=True)  # -> List, Index
L_3 = ClusterOutput(subset.List)
L_4 = ClusterOutput(shift)
