# Grasshopper definition Helper_XYZOnPlane.gh (Grasshopper 0.9.76)

pt = Point(<point referenced from the Rhino model>)
crv = Curve(<curve referenced from the Rhino model>)
panel = Panel("""Establish Plane
from Curve""")
end = EndPoints(Curve=crv)  # -> Start, End
vec = Vector(crv)
pl = ConstructPlane(Origin=end.Start, XAxis=vec, YAxis=Vector(0, 1, 0))
# Create Vector or Point in Plane
xyzplane = XYZPlane(pl=pl, xfactor=Slider(0, range=0..10), yfactor=Slider(0, range=0..10), zfactor=Slider(2, range=0..10))  # -> O_2, pt_2, vec_3
move = Move(Geometry=pt, Motion=xyzplane.vec_3)  # -> Geometry, Transform
pt_2 = Point(xyzplane.vec_3)

# ==== cluster XYZPlane
pl = ClusterInput()
xfactor = ClusterInput()
yfactor = ClusterInput()
zfactor = ClusterInput()
deplane = DeconstructPlane(Plane=pl)  # -> Origin, XAxis, YAxis, ZAxis
multiplication = Multiplication(XAxisVec=deplane.XAxis, XFactor=xfactor)
multiplication_2 = Multiplication(YAxisVec=deplane.YAxis, YFactor=yfactor)
multiplication_3 = Multiplication(ZAxisVec=deplane.ZAxis, ZFactor=zfactor)
vec = Vector(deplane.Origin)
ma = MassAddition(Input=[multiplication, multiplication_2, multiplication_3])  # -> Result, PartialResults
move = Move(Geometry=ma.Result, Motion=vec)  # -> Geometry, Transform
O = Point(deplane.Origin)
pt = Point(move.Geometry)
vec_2 = Vector(ma.Result)
vec_3 = ClusterOutput(vec_2)
O_2 = ClusterOutput(O)
pt_2 = ClusterOutput(pt)
