# Grasshopper definition ContinuousForce_2.gh (Grasshopper 0.9.76)
# plug-ins: Kangaroo Components, Weaverbird

crv = Curve(flatten([<curve referenced from the Rhino model> x6]))
boundary = BoundarySurfaces(Edges=flatten(crv))

crv_2 = Curve(<curve referenced from the Rhino model>)

divide = DivideCurve(Curve=crv, Count=Slider(7, range=0..1000), Kinks=False)  # -> Points, Tangents, Parameters
popgeo = PopulateGeometry(Geometry=boundary, Count=Slider(817, range=0..1000), Seed=1)
number_slider = Slider(10, range=0..10)
number_slider_2 = Slider(0, range=0..10000)
number_slider_3 = Slider(2.3, range=0..10)
ptfixed = Point(divide.Points)
pt = Point([divide.Points, popgeo])

divide_2 = DivideCurve(Curve=crv_2, Count=Slider(71, range=0..100), Kinks=False)  # -> Points, Tangents, Parameters
pline = PolyLine(Vertices=divide_2.Points, Closed=False)
explode = Explode(Curve=pline, Recursive=True)  # -> Segments, Vertices
Z = UnitZ(Factor=Slider(-8.4, range=-100..100))
end = EndPoints(Curve=crv_2)  # -> Start, End
pt_2 = Point(explode.Vertices)
springs = SpringsFromLine(Connection=explode.Segments, Stiffness=1000, Damping=10, RestLength=0, UpperCutoff=0, LowerCutoff=0, Plasticity=0)
uforce = UnaryForce(Point=pt_2, Force=Z)
pt_3 = Point([end.Start, end.End])
crv_3 = Curve(explode.Segments)

crv_4 = Curve([<curve referenced from the Rhino model> x2853])
con = DelaunayEdges(Points=pt, Plane=PlaneXY(0, 0, 0))  # -> flatten(Connectivity), flatten(Edges)
len = Length(Curve=con.Edges)
pt_4 = Point(flatten(pt))
Z_2 = UnitZ(Factor=Slider(13.75, range=0..100))
crv_5 = Curve(con.Edges)
smaller = SmallerThan(FirstNumber=len, SecondNumber=Slider(4.895, range=0..10))  # -> SmallerThan, OrEqualTo
pline_2 = PolyLine(Vertices=divide.Points, Closed=False)
uforce_2 = UnaryForce(Point=pt_4, Force=Z_2)
dispatch = Dispatch(List=crv_5, DispatchPattern=smaller.SmallerThan)  # -> ListA, ListB

timer = Timer(TimerInterval=20, Target=kangaroo)
kangaroo = KangarooPhysics(ForceObjects=flatten([springs, uforce]), AnchorPoints=pt_3, Settings=null, Geometry=crv_3, SimulationReset=Toggle(True))  # -> Out, Iterations, ParticlesOut, GeometryOut, KE

crv_6 = Curve(dispatch.ListA)
explode_2 = Explode(Curve=pline_2, Recursive=True)  # -> Segments, Vertices
dupln = RemoveDuplicateLines(Lines=flatten([crv_6, explode_2.Segments]), Tolerance=0.01)
equalize = Equalize(Lines=dupln, EqNStrength=Slider(3, range=0..10))
springs_2 = SpringsFromLine(
    Connection=dupln,
    Stiffness=Slider(25.25, range=0..100),
    Damping=number_slider_3,
    RestLength=number_slider_3,
    UpperCutoff=0,
    LowerCutoff=0,
    Plasticity=0)
pt_5 = Point(explode_2.Vertices)
kangaroo_2 = KangarooPhysics(
    ForceObjects=flatten([springs_2, uforce_2, equalize]),
    AnchorPoints=pt_5,
    Settings=null,
    Geometry=dupln,
    SimulationReset=Toggle(False))  # -> Out, Iterations, ParticlesOut, GeometryOut, KE
timer_2 = Timer(TimerInterval=20, Target=kangaroo_2)
wbweave = WeaverbirdsMeshFromLinesWeaveBack(Lines=kangaroo_2.GeometryOut, MaximumValence=4)  # disabled
crv_7 = Curve(kangaroo_2.GeometryOut)
mesh = Mesh(wbweave)
preview = CustomPreview(Geometry=crv_7, Shader=ColourSwatch(SwatchColor=RGB(20, 21, 73)))
