# Grasshopper definition RelaxedGeometry.gh (Grasshopper 0.9.76)
# plug-ins: Kangaroo Components, Weaverbird

brep = Brep(<brep referenced from the Rhino model>)

# ---- group: Cutting Planes
brep_2 = Brep(brep)
bbox = BoundingBox(Content=brep_2, Plane=PlaneXY(0, 0, 0))  # -> Box, Box_2
box_corners = BoxCorners(Box=bbox.Box)  # -> CornerA, CornerB, CornerC, CornerD, CornerE, CornerF, CornerG, CornerH
number_slider = Slider(26, range=0..100)
pdecon = Deconstruct(Point=box_corners.CornerA)  # -> XComponent, YComponent, ZComponent
pdecon_2 = Deconstruct(Point=box_corners.CornerH)  # -> XComponent, YComponent, ZComponent
division = Division(A=pdecon_2.ZComponent, B=number_slider)
series = Series(Start=pdecon.ZComponent, Step=division, Count=expr("x+1", number_slider))
pt = ConstructPoint(XCoordinate=0, YCoordinate=0, ZCoordinate=series)
xy = XYPlane(Origin=pt)

# ----
multiplication = Multiplication(A=number_slider, B=Slider(2, range=0..10))

# ---- group: Cutting Planes
brep_3 = Brep(brep)
bbox_2 = BoundingBox(Content=brep_3, Plane=PlaneXY(0, 0, 0))  # -> Box, Box_2
box_corners_2 = BoxCorners(Box=bbox_2.Box)  # -> CornerA, CornerB, CornerC, CornerD, CornerE, CornerF, CornerG, CornerH
pdecon_3 = Deconstruct(Point=box_corners_2.CornerA)  # -> XComponent, YComponent, ZComponent
pdecon_4 = Deconstruct(Point=box_corners_2.CornerH)  # -> XComponent, YComponent, ZComponent
division_2 = Division(A=pdecon_4.ZComponent, B=multiplication)
series_2 = Series(Start=pdecon_3.ZComponent, Step=division_2, Count=expr("x+1", multiplication))
pt_2 = ConstructPoint(XCoordinate=0, YCoordinate=0, ZCoordinate=series_2)
xy_2 = XYPlane(Origin=pt_2)

# ----
sec = BrepPlane(Brep=brep, Plane=xy_2)  # -> flatten(Curves), Points
sec_2 = BrepPlane(Brep=brep, Plane=xy)  # -> flatten(Curves), Points
rev = ReverseList(List=sec_2.Curves)
item = ListItem(List=sec_2.Curves, Index=0, Wrap=True)
number_slider_2 = Slider(25, range=0..100)

# ---- group: CURVE LACER
crv = Curve(sec_2.Curves)
shifter = Shifter(L=crv, L_2=crv)  # -> L_3, L_4
divide = DivideCurve(Curve=shifter.L_3, Count=number_slider_2, Kinks=False)  # -> simplify(Points), Tangents, Parameters
divide_2 = DivideCurve(Curve=shifter.L_4, Count=number_slider_2, Kinks=False)  # -> simplify(Points), Tangents, Parameters
shifter_2 = Shifter(L=divide.Points, L_2=divide_2.Points)  # -> L_3, L_4
shifter_3 = Shifter(L=divide_2.Points, L_2=divide.Points)  # -> L_3, L_4
ln = Line(StartPoint=shifter_2.L_3, EndPoint=shifter_2.L_4)
ln_2 = Line(StartPoint=shifter_3.L_3, EndPoint=shifter_3.L_4)
crv_2 = Curve(flatten([ln, ln_2]))

# ----
item_2 = ListItem(List=rev, Index=0, Wrap=True)
pline = PolyLine(Vertices=divide.Points, Closed=False)
divide_3 = DivideCurve(Curve=item, Count=number_slider_2, Kinks=False)  # -> Points, Tangents, Parameters
divide_4 = DivideCurve(Curve=item_2, Count=number_slider_2, Kinks=False)  # -> Points, Tangents, Parameters
explode = Explode(Curve=pline, Recursive=True)  # -> flatten(Segments), Vertices
curvepoint = PointOnCurve(crv_2, parameter=0.5)
pt_3 = Point([divide_4.Points, divide_3.Points])
crv_cp = CurveClosestPoint(Point=curvepoint, Curve=crv_2)  # -> Point, Parameter, Distance
shatter = Shatter(Curve=crv_2, Parameters=crv_cp.Parameter)  # -> flatten(Segments)
crv_3 = Curve(flatten([explode.Segments, shatter]))
number_slider_3 = Slider(0.08, range=0..0.1)

pt_4 = Point(flatten(pt_3))
crv_4 = Curve(crv_3)

explode_2 = Explode(Curve=crv_4, Recursive=True)  # -> Segments, Vertices
duppt = RemoveDuplicatePts(Points=flatten(explode_2.Vertices), Tolerance=0.01)

# ---- group: FORCES
lines = Curve(crv_4)
number_slider_4 = Slider(1, range=0..100)
Z = UnitZ(Factor=Slider(-15.4, range=-100..100))
equalize = Equalize(Lines=lines, EqNStrength=Slider(6.7, range=0..10))  # disabled
springs = SpringsFromLine(
    Connection=lines,
    Stiffness=Slider(1000, range=0..1000),
    Damping=10,
    RestLength=Slider(0.3, range=0..10),
    UpperCutoff=0,
    LowerCutoff=0,
    Plasticity=0)
uforce = UnaryForce(Point=duppt, Force=Z)

# ----
kangaroo = KangarooPhysics(
    ForceObjects=flatten([uforce, springs, equalize]),
    AnchorPoints=pt_4,
    Settings=null,
    Geometry=crv_4,
    SimulationReset=Toggle(True))  # -> Out, Iterations, ParticlesOut, GeometryOut, KE; disabled
timer = Timer(TimerInterval=20, Target=kangaroo)

wbweave = WeaverbirdsMeshFromLinesWeaveBack(Lines=kangaroo.GeometryOut, MaximumValence=4)

# ==== cluster Shifter
L = ClusterInput()
L_2 = ClusterInput()
shift = ShiftList(List=L_2, Shift=1, Wrap=Toggle(False))
lng = ListLength(List=shift)
dom = ConstructDomain(DomainStart=0, DomainEnd=expr("x-1", lng))
subset = SubList(List=L, Domain=dom, Wrap=True)  # -> List, Index
L_3 = ClusterOutput(subset.List)
L_4 = ClusterOutput(shift)
