# Grasshopper definition Mesh_LowPoly.gh (Grasshopper 0.9.76)
# plug-ins: Kangaroo Components, Weaverbird

msphere = MeshSphere(Base=PlaneXY(0, 0, 0), Radius=10, UCount=Slider(5, range=0..100), VCount=Slider(11, range=0..100))
wbmidedge = WeaverbirdsMidedgeSubdivision(MeshCurves=msphere, Level=1, SmoothNakedEdges=1)
wbtriangles = WeaverbirdsSplitTrianglesSubdivision(MeshCurves=msphere, Level=1)
wbloop = WeaverbirdsLoopSubdivision(MeshCurves=msphere, Level=1, SmoothNakedEdges=1)
wbsplitquads = WeaverbirdsConstantQuadsSplitSubdivision(MeshCurves=msphere, Level=1, SmoothNakedEdges=1)
rm = ReMesh(
    InitialMesh=wbloop,
    EdgeLength=Slider(4, range=0..10),
    Tolerance=0.1,
    PullStrength=1,
    TargetMesh=wbloop,
    Reset=Toggle(False))  # -> ReMesh, Iterations
preview = CustomPreview(
    Geometry=rm.ReMesh,
    Shader={ambient=RGB(0, 0, 0), diffuse=RGB(255, 105, 180), emission=RGB(76, 32, 54), shine=0.5, specular=RGB(255, 255, 255), transparency=0})
