# Grasshopper definition Python_Points.gh (Grasshopper 0.9.76)
# Copyright: Nono 2013
# plug-ins: Python Interpreter

xy = XYPlane(Origin=Point(0, 0, 0))
Y = Slider(3, range=0..10)
filletradius = Slider(0.3, range=0..1)
X = Slider(4, range=0..10)
recfromcenter = RecFromCenter(pln=xy, X=X, Y=Y, R=filletradius)  # -> G, L
panel = Panel(recfromcenter.L)
rectangle = Curve(recfromcenter.G)
boundary = BoundarySurfaces(Edges=rectangle)
popgeo = PopulateGeometry(Geometry=boundary, Count=Slider(2, range=0..100), Seed=1)
python = PythonScript(points=popgeo, y=Slider(0.65, range=0..1))  # -> out, a; inputs points: list
# ---------- python: Python ----------
# Import Rhino Python libraries
import rhinoscriptsyntax as rs
import Rhino

circles = []
circleRadius = y

# Iterate through Grasshopper's point list
for point in points:
    pt = Rhino.Geometry.Point3d(rs.coerce3dpoint(point))
    
    # Draw a circle on each point
    circle = Rhino.Geometry.Circle(pt, circleRadius)     
    circles.append(circle)
    print circle

a = circles
# ---------- end python ----------
a_x = PythonScript()  # -> out, a
# ---------- a_x: Python ----------
a = x
# ---------- end a_x ----------
panel_2 = Panel(python.out)
panel_3 = Panel(python.a)

# ==== cluster RecFromCenter
Y = ClusterInput()
X = ClusterInput()
pln = ClusterInput()
Y_2 = Number(Y)
X_2 = Number(X)
pln_2 = Plane(pln)
R = ClusterInput()
deplane = DeconstructPlane(Plane=pln_2)  # -> Origin, XAxis, YAxis, ZAxis
rectangle = Rectangle(Plane=pln_2, XSize=X_2, YSize=Y_2, Radius=R)  # -> Rectangle, Length
neg = Negative(Value=deplane.XAxis)
neg_2 = Negative(Value=deplane.YAxis)
L = ClusterOutput(rectangle.Length)
multiplication = Multiplication(A=neg_2, B="0.5")
multiplication_2 = Multiplication(A=neg, B="0.5")
multiplication_3 = Multiplication(A=multiplication, B=Y_2)
multiplication_4 = Multiplication(A=multiplication_2, B=X_2)
addition = Addition(A=multiplication_3, B=multiplication_4)
move = Move(Geometry=rectangle.Rectangle, Motion=addition)  # -> Geometry, Transform
G = ClusterOutput(move.Geometry)
