# Grasshopper definition Srf_Drafting_Layer.gh (Grasshopper 0.9.76)
# plug-ins: HDTReference

panel = Panel("Plan Closed Curves")
pipeline = GeometryPipeline(
    GroupByLayer=False,
    GroupByType=False,
    IncludeHidden=True,
    IncludeLocked=True,
    LayerFilter="Lines",
    NameFilter="*",
    TypeFilter=4)
boundary = BoundarySurfaces(Edges=pipeline)
number_slider = Slider(1, range=0..1)
Z = UnitZ(Factor=Slider(4, range=0..10))
neg = Negative(Value=number_slider)
extr = Extrude(Base=boundary, Direction=Z)
vec = VectorXYZ(XComponent=0, YComponent=number_slider, ZComponent=neg)  # -> Vector, Length
brep = Brep(extr)
projecta = ProjectAlong(Geometry=brep, Plane=PlaneXY(0, 0, 0), Direction=vec.Vector)  # -> Geometry, Transform
debrep = DeconstructBrep(Brep=projecta.Geometry)  # -> Faces, Edges, Vertices
crv = Curve(debrep.Edges)
crv_2 = Curve(debrep.Faces)
runion = RegionUnion(Curves=flatten(crv_2))
boundary_2 = BoundarySurfaces(Edges=runion)
preview = CustomPreview(Geometry=boundary_2, Shader=ColourSwatch(SwatchColor=RGBA(255, 255, 255, 68)))
previewlw = CustomPreviewLineweights(Geometry=crv, Shader=ColourSwatch(SwatchColor=RGB(33, 41, 55)))
previewlw_2 = CustomPreviewLineweights(Geometry=runion, Shader=ColourSwatch(SwatchColor=RGB(0, 0, 0)), Thickness=Slider(2.78, range=0..10))
