# Grasshopper definition Srf_Section.gh (Grasshopper 0.9.76)
# Copyright: Nono 2013
# plug-ins: HDTReference

number_slider = Slider(10, range=0..10)
geometry_pipeline = GeometryPipeline(
    GroupByLayer=False,
    GroupByType=False,
    IncludeHidden=True,
    IncludeLocked=True,
    LayerFilter="REF_Object",
    NameFilter="*",
    TypeFilter=1073741848)
series = Series(Start=Slider(5, range=0..10), Step=Slider(1, range=0..10), Count=Slider(25, range=0..100))
number_slider_2 = Slider(15, range=0..100)
number_slider_3 = Slider(7, range=0..100)
cluster = Cluster(srf=geometry_pipeline, num=series)
item = ListItem(List=cluster, Index=0, Wrap=True)
number_slider_4 = Slider(5, range=0..10)
lng = ListLength(List=flatten(item))
xy = XYPlane(Origin=Point(0, 0, 0))
X = Slider(4, range=0..10)
Y = Slider(4, range=0..10)
filletradius = Slider(0, range=0..1)
series_2 = Series(Start=number_slider_4, Step=number_slider_4, Count=lng)
neg = Negative(Value=series_2)
vec = VectorXYZ(XComponent=series_2, YComponent=neg, ZComponent=0)  # -> graft(Vector), Length
recfromcenter = RecFromCenter(pln=xy, X=X, Y=Y, R=filletradius)  # -> G, L
move = Move(Geometry=cluster, Motion=vec.Vector)  # -> Geometry, Transform
panel = Panel(recfromcenter.L)
rectangle = Curve(recfromcenter.G)

edge = Edge(E=move.Geometry)
previewlw = CustomPreviewLineweights(Geometry=edge, Shader=ColourSwatch(SwatchColor=RGB(0, 0, 0)), Thickness=Slider(3.93, range=0..10))
preview = CustomPreview(Geometry=move.Geometry, Shader=ColourSwatch(SwatchColor=RGB(88, 89, 89)))

# ==== cluster RecFromCenter
Y = ClusterInput()
X = ClusterInput()
pln = ClusterInput()
Y_2 = Number(Y)
X_2 = Number(X)
pln_2 = Plane(pln)
R = ClusterInput()
deplane = DeconstructPlane(Plane=pln_2)  # -> Origin, XAxis, YAxis, ZAxis
rectangle = Rectangle(Plane=pln_2, XSize=X_2, YSize=Y_2, Radius=R)  # -> Rectangle, Length
neg = Negative(Value=deplane.XAxis)
neg_2 = Negative(Value=deplane.YAxis)
L = ClusterOutput(rectangle.Length)
multiplication = Multiplication(A=neg_2, B="0.5")
multiplication_2 = Multiplication(A=neg, B="0.5")
multiplication_3 = Multiplication(A=multiplication, B=Y_2)
multiplication_4 = Multiplication(A=multiplication_2, B=X_2)
addition = Addition(A=multiplication_3, B=multiplication_4)
move = Move(Geometry=rectangle.Rectangle, Motion=addition)  # -> Geometry, Transform
G = ClusterOutput(move.Geometry)

# ==== cluster Cluster
srf = ClusterInput()
num = ClusterInput()
srf_2 = Surface(srf)
num_2 = Number(num)
bbox = BoundingBox(Content=srf_2, Plane=PlaneXY(0, 0, 0))  # -> Box, Box_2
box_corners = BoxCorners(Box=bbox.Box)  # -> CornerA, CornerB, CornerC, CornerD, CornerE, CornerF, CornerG, CornerH
ln = Line(StartPoint=box_corners.CornerE, EndPoint=box_corners.CornerF)
ln_2 = Line(StartPoint=box_corners.CornerF, EndPoint=box_corners.CornerG)
pframes = PerpFrames(Curve=ln_2, Count=num_2, Align=True)  # -> simplify(Frames), Parameters
pframes_2 = PerpFrames(Curve=ln, Count=num_2, Align=True)  # -> simplify(Frames), Parameters
srf_3 = Surface(srf_2)
sec = BrepPlane(Brep=srf_3, Plane=pframes_2.Frames)  # -> Curves, Points
sec_2 = BrepPlane(Brep=srf_3, Plane=pframes.Frames)  # -> Curves, Points
path_mapper = PathMapper(sec.Curves, source="{a;b}", target="{a}")
path_mapper_2 = PathMapper(sec_2.Curves, source="{a;b}", target="{a}")
geo = Geometry([path_mapper, path_mapper_2])
geo_2 = ClusterOutput(geo)

# ==== cluster Edge
E = ClusterInput()
srf = BoundarySurfaces(Edges=E)
edges = BrepEdges(Brep=srf)  # -> Naked, Interior, NonManifold
en = ClusterOutput(edges.Naked)
